# Grasshopper definition GetGamePadTypes.gh (Grasshopper 1.0.8)

c_sdl3 = CSharpScript(run=Toggle(False))  # -> out, a; inputs run: Boolean
# ---------- c_sdl3: C# ----------
#r "nuget: SDL3-CS, 3.3.2"

using System;
using System.Linq;
using System.Collections;
using System.Collections.Generic;
using System.Drawing;

using Rhino;
using Rhino.Geometry;

using Grasshopper;
using Grasshopper.Kernel;
using Grasshopper.Kernel.Data;
using Grasshopper.Kernel.Types;

using System.Threading;
using System.Threading.Tasks;

using SDL3;
using static SDL3.SDL;
using System.Runtime.InteropServices;

public class Script_Instance : GH_ScriptInstance
{
    public enum Status
    {
        NotInitialized =0,
        Started =1,
        Stopped =2
    }

    private static CancellationTokenSource _cts;
    private static Status _status = Status.NotInitialized; 
    private List<int> _log;

    private void RunScript(bool run, object y, ref object a)
    {
        //https://chatgpt.com/c/68fe48c9-dc1c-832e-aad0-593c820411f4
        //https://github.com/libsdl-org/SDL/releases/tag/release-3.2.24

        if(_status == Status.NotInitialized && run)
        {
            Initialize();
            Start();
        } else if (_status == Status.Stopped && run)
            Start();
        else if (_status == Status.Started && !run)
            Stop();
    }

    async Task Loop(CancellationToken token)
    {
          // C library
        NativeLibrary.Load(@"C:\Git\Daxs\GH_Tests\SDL3.dll");

        if (!SDL.Init(SDL.InitFlags.Gamepad ))
        {
            RhinoApp.WriteLine($"SDL init failed: {SDL.GetError()}");
            return;
        }

        int added = SDL.AddGamepadMappingsFromFile(@"C:\Git\Daxs\GH_Tests\gamecontrollerdb.txt");
        RhinoApp.WriteLine($"Loaded {added} mappings");

        SDL.PumpEvents();

        uint[] gamepads = SDL.GetGamepads(out int numGamepads);
        RhinoApp.WriteLine($"Detected {numGamepads} gamepad(s)");

        // --- Open all gamepads ---
        IntPtr[] openedPads = new IntPtr[numGamepads];
        for (int i = 0; i < numGamepads; i++)
        {
            uint id = gamepads[i];
            openedPads[i] = SDL.OpenGamepad(id);
            if (openedPads[i] == IntPtr.Zero)
            {
                RhinoApp.WriteLine($"Failed to open gamepad {i}: {SDL.GetError()}");
                continue;
            }

            string name = SDL.GetGamepadName(openedPads[i]);
            ushort vendor = SDL.GetGamepadVendor(openedPads[i]);
            ushort product = SDL.GetGamepadProduct(openedPads[i]);
            RhinoApp.WriteLine($"[{i}] {name} (VID:0x{vendor:X4}, PID:0x{product:X4})");
        }

        while (!token.IsCancellationRequested)
        {
            SDL.PumpEvents();

            for (int i = 0; i < numGamepads; i++)
            {
                IntPtr gp = openedPads[i];
                if (gp == IntPtr.Zero) continue;

                // Buttons (standard Xbox-like layout)
                bool aBtn = SDL.GetGamepadButton(gp, GamepadButton.South);
                bool bBtn = SDL.GetGamepadButton(gp, GamepadButton.East);
                bool xBtn = SDL.GetGamepadButton(gp, GamepadButton.West);
                bool yBtn = SDL.GetGamepadButton(gp, GamepadButton.North);

                bool startBtn = SDL.GetGamepadButton(gp,GamepadButton.Start);
                bool backBtn = SDL.GetGamepadButton(gp, GamepadButton.Back);

                ushort lowFreq = 30000;  // left motor
                ushort highFreq = 40000; // right motor
                uint durationMs = 150;   // milliseconds

                if  (startBtn)
                {
                    SDL.SetGamepadLED(gp, 255,255,0);
                    SDL.RumbleGamepad(gp,lowFreq,highFreq,durationMs);
                    SDL.RumbleGamepadTriggers(gp,lowFreq,highFreq,durationMs);
                }else
                    SDL.SetGamepadLED(gp, 255,255,255);

                //DPAD
                bool dPadUp = SDL.GetGamepadButton(gp, GamepadButton.DPadUp);
                bool dPadDown = SDL.GetGamepadButton(gp, GamepadButton.DPadDown);
                bool dPadLeft = SDL.GetGamepadButton(gp, GamepadButton.DPadLeft);
                bool dPadRight = SDL.GetGamepadButton(gp, GamepadButton.DPadRight);

                bool rightStick = SDL.GetGamepadButton(gp, GamepadButton.RightStick);
                bool lefttStick = SDL.GetGamepadButton(gp, GamepadButton.LeftStick);

                bool lShoulder = SDL.GetGamepadButton(gp, GamepadButton.LeftShoulder);
                bool rShoulder = SDL.GetGamepadButton(gp, GamepadButton.RightShoulder);

                // Axes (normalized to -1..1)
                
                float lx = SDL.GetGamepadAxis(gp, GamepadAxis.LeftX) / 32767f;
                float ly = SDL.GetGamepadAxis(gp, GamepadAxis.LeftY) / 32767f;
                float rx = SDL.GetGamepadAxis(gp, GamepadAxis.RightX) / 32767f;
                float ry = SDL.GetGamepadAxis(gp, GamepadAxis.RightY) / 32767f;

                float lt = SDL.GetGamepadAxis(gp, GamepadAxis.LeftTrigger) / 32767f;
                float rt = SDL.GetGamepadAxis(gp, GamepadAxis.RightTrigger) / 32767f;

            

         // Build a clean summary string for the current controller
string line = $@"
🎮 Pad {i}: 
  [Buttons]  A:{aBtn,-5}  B:{bBtn,-5}  X:{xBtn,-5}  Y:{yBtn,-5}  Start:{startBtn,-5}  Back:{backBtn,-5} 
  [Shoulder] LB:{lShoulder,-5}  RB:{rShoulder,-5}  L3:{lefttStick,-5}  R3:{rightStick,-5}
  [Triggers] LT:{lt,6:0.00}  RT:{rt,6:0.00}
  [DPad] UP:{dPadUp,-5}  DOWN:{dPadDown,-5} LEFT:{dPadLeft,-5}  RIGHT:{dPadRight,-5}
  [Sticks]   L({lx,6:0.00},{ly,6:0.00})   R({rx,6:0.00},{ry,6:0.00})
";

RhinoApp.WriteLine(line);
  }

            await Task.Delay(100, token);
        }  
        
    }
    

    void Initialize()
    {
        _log = new List<int>();
    }

    void Start()
    {
        _cts = new CancellationTokenSource();
        _ = Task.Run(() => Loop(_cts.Token), _cts.Token);
        _status = Status.Started;
    }

    void Stop()
    {
        _cts.Cancel();
        _status = Status.Stopped;
    }
}
# ---------- end c_sdl3 ----------
# X = B0
# Y = B3
# B = B2
# A = B1
# 
# Back = B8
# Start = B9
# 
# L1 = B4
# L2 = B10 + RotationX (0-65535)
# L3.x = X (0-65535)
# L3.y = Y (0-65535)
# 
# R1 = B5
# R2 = B11 + RotationY (0-65535)
# R3.x = Z (0-65535)
# R3.y = RotationZ (0-65535)
c_state = CSharpScript(y=Button())  # -> out, a; disabled
# ---------- c_state: C# ----------
#r "nuget: SharpDX.DirectInput, 4.2.0"
#r "nuget: SharpDX, 4.2.0"

// Grasshopper Script Instance
#region Usings
using System;
using System.Linq;
using System.Collections;
using System.Collections.Generic;
using System.Drawing;

using Rhino;
using Rhino.Geometry;

using Grasshopper;
using Grasshopper.Kernel;
using Grasshopper.Kernel.Data;
using Grasshopper.Kernel.Types;
   using SharpDX.DirectInput;
#endregion

public class Script_Instance : GH_ScriptInstance
{
    Joystick _joystick = null;

    

    private void RunScript(object x, object y, ref object a)
    {
      if (_joystick == null)
        GetJoystick();

    // Read current state
    var state = _joystick.GetCurrentState();
    if (state == null)
    {
        a = "Failed to read joystick state.";
        return;
    }


        var directInput = new DirectInput();

         // Enumerate all attached game controllers
        foreach (var deviceInstance in directInput.GetDevices(DeviceType.Gamepad, DeviceEnumerationFlags.AllDevices))
        {
            Console.WriteLine($"Gamepad: {deviceInstance.ProductName} ({deviceInstance.ProductGuid})");
        }

    var debug = new System.Text.StringBuilder();

    // Axes
    debug.AppendLine("=== Axes ===");
    debug.AppendLine($"X: {state.X}");
    debug.AppendLine($"Y: {state.Y}");
    debug.AppendLine($"Z: {state.Z}");
    debug.AppendLine($"RotationX: {state.RotationX}");
    debug.AppendLine($"RotationY: {state.RotationY}");
    debug.AppendLine($"RotationZ: {state.RotationZ}");

    // Sliders
    debug.AppendLine("=== Sliders ===");
    foreach (var s in state.Sliders)
        debug.AppendLine($"Slider: {s}");

    // Velocity
    debug.AppendLine("=== Velocity ===");
    debug.AppendLine($"VelocityX: {state.VelocityX}");
    debug.AppendLine($"VelocityY: {state.VelocityY}");
    debug.AppendLine($"VelocityZ: {state.VelocityZ}");
    debug.AppendLine($"AngularVelocityX: {state.AngularVelocityX}");
    debug.AppendLine($"AngularVelocityY: {state.AngularVelocityY}");
    debug.AppendLine($"AngularVelocityZ: {state.AngularVelocityZ}");

    // Acceleration
    debug.AppendLine("=== Acceleration ===");
    debug.AppendLine($"AccelerationX: {state.AccelerationX}");
    debug.AppendLine($"AccelerationY: {state.AccelerationY}");
    debug.AppendLine($"AccelerationZ: {state.AccelerationZ}");
    debug.AppendLine($"AngularAccelerationX: {state.AngularAccelerationX}");
    debug.AppendLine($"AngularAccelerationY: {state.AngularAccelerationY}");
    debug.AppendLine($"AngularAccelerationZ: {state.AngularAccelerationZ}");

    // Force
    debug.AppendLine("=== Force ===");
    debug.AppendLine($"ForceX: {state.ForceX}");
    debug.AppendLine($"ForceY: {state.ForceY}");
    debug.AppendLine($"ForceZ: {state.ForceZ}");
    debug.AppendLine($"TorqueX: {state.TorqueX}");
    debug.AppendLine($"TorqueY: {state.TorqueY}");
    debug.AppendLine($"TorqueZ: {state.TorqueZ}");

    // Buttons
    debug.AppendLine("=== Buttons ===");
    for (int i = 0; i < state.Buttons.Length; i++)
    {
        debug.AppendLine($"Button {i}: {(state.Buttons[i] ? "----------->Pressed" : "Released")}");
    }

    // POV (D-Pad)
    debug.AppendLine("=== POV (D-Pad) ===");
    for (int i = 0; i < state.PointOfViewControllers.Length; i++)
    {
        int pov = state.PointOfViewControllers[i];
        debug.AppendLine($"POV {i}: {(pov == -1 ? "Centered" : pov + "°")}");
    }

    // Output to component
    a = debug.ToString();
    }


    void GetJoystick()
    {
        var directInput = new DirectInput();



        // Find a connected game controller
        var devices = directInput.GetDevices(DeviceClass.GameControl, DeviceEnumerationFlags.AttachedOnly);
        if (!devices.Any())
            throw new InvalidOperationException("No game control devices found.");

        // Pick the first one
        var deviceInstance = devices.First();
        Console.WriteLine("Using device: " + deviceInstance.ProductName);

        // Create joystick
        _joystick = new Joystick(directInput, deviceInstance.InstanceGuid);

        // Acquire the device
        _joystick.Properties.BufferSize = 128;
        _joystick.Acquire();
    }
}
# ---------- end c_state ----------
c_gamepad_type = CSharpScript(y=Button())  # -> out, a; disabled
# ---------- c_gamepad_type: C# ----------
#r "nuget: SharpDX.DirectInput, 4.2.0"
#r "nuget: SharpDX, 4.2.0"

// Grasshopper Script Instance
#region Usings
using System;
using System.Linq;
using System.Collections;
using System.Collections.Generic;
using System.Drawing;

using Rhino;
using Rhino.Geometry;

using Grasshopper;
using Grasshopper.Kernel;
using Grasshopper.Kernel.Data;
using Grasshopper.Kernel.Types;
   using SharpDX.DirectInput;
#endregion

public class Script_Instance : GH_ScriptInstance
{
    private void RunScript(object x, object y, ref object a)
    {
        var directInput = new DirectInput();
        var debug = new System.Text.StringBuilder();

        // Standard Sony DualShock 4 IDs (054C is Sony)

        

// Dictionary<int, int[]>

        const int SonyVendorId = 0x054C;
        const int Ds4ProductId_v1 = 0x05C4;
        const int Ds4ProductId_v2 = 0x09CC;

        foreach (var deviceInstance in directInput.GetDevices(DeviceClass.GameControl, DeviceEnumerationFlags.AllDevices))
        {
            debug.AppendLine($"-------------------------------------");
            debug.AppendLine($"Joystick: {deviceInstance.ProductName} ({deviceInstance.ProductGuid})");
            
            var guid = deviceInstance.ProductGuid;
            byte[] guidBytes = guid.ToByteArray();

            ushort vendorId = (ushort)((guidBytes[1] << 8) | guidBytes[0]); 
            ushort productId = (ushort)((guidBytes[3] << 8) | guidBytes[2]);

            string controllerName = deviceInstance.ProductName;
    
            debug.AppendLine($"Device Name: {controllerName}");
            debug.AppendLine($"GUID: {guid}");
            debug.AppendLine($"VID: {vendorId:X4}, PID: {productId:X4}"); // Use X4 for Hex output

            // Explicitly check if it's a PS4 controller
            if (vendorId == SonyVendorId && (productId == Ds4ProductId_v1 || productId == Ds4ProductId_v2))
            {
                debug.AppendLine("*** SUCCESS: IDENTIFIED AS SONY S4 CONTROLLER! ***");
            }
        } 




   
    // Output to component
    a = debug.ToString();
    }

}
# ---------- end c_gamepad_type ----------
c_gp_types = CSharpScript(y=Button())  # -> out, a; disabled
# ---------- c_gp_types: C# ----------
using System;
using System.Linq;
using System.Collections;
using System.Collections.Generic;
using System.Drawing;

using Rhino;
using Rhino.Geometry;

using Grasshopper;
using Grasshopper.Kernel;
using Grasshopper.Kernel.Data;
using Grasshopper.Kernel.Types;

using System;
using SharpDX.DirectInput;

#r "nuget: SharpDX.DirectInput, 4.2.0"
#r "nuget: SharpDX, 4.2.0"


public class Script_Instance : GH_ScriptInstance
{
    private void RunScript(object x, object y, ref object a)
    {
        //https://chatgpt.com/g/g-p-67e9bd1beeac8191a0f9ff9d384c27a1-xboxcontroller/c/68fb7321-1e04-832b-b768-57e00823301e
        var directInput = new DirectInput();



        var device = directInput.GetDevices(DeviceClass.GameControl, DeviceEnumerationFlags.AllDevices).FirstOrDefault();


        if (device != null)
        {
            var joystick = new Joystick(directInput, device.InstanceGuid);
            string controllerName = ControllerDatabase.GetControllerName(joystick, out var type);

            Console.WriteLine($"Detected: {controllerName}");
            Console.WriteLine($"ControllerType: {type}");
        }

    }



public enum ControllerType
{
    Unknown,
    PlayStation3,
    PlayStation4,
    PlayStation5,
    Xbox360,
    XboxOne,
    XboxSeries,
    NintendoSwitch,
    PC,
    Generic,
    Steam
}

public struct ControllerVendor
{
    public int VendorId { get; }
    public string VendorName { get; }
    public ControllerType DefaultType { get; }
    public ProductInfo[] Products { get; }

    public ControllerVendor(int vendorId, string vendorName, ControllerType defaultType, ProductInfo[] products)
    {
        VendorId = vendorId;
        VendorName = vendorName;
        DefaultType = defaultType;
        Products = products;
    }

    public struct ProductInfo
    {
        public int ProductId { get; }
        public string ProductName { get; }
        public ControllerType Type { get; }

        public ProductInfo(int productId, string productName, ControllerType type)
        {
            ProductId = productId;
            ProductName = productName;
            Type = type;
        }
    }
}

public static class ControllerDatabase
{
    public static readonly ControllerVendor[] Vendors =
    {
        // 🎮 SONY
        new ControllerVendor(
            0x054C, "Sony", ControllerType.PlayStation4, new []
            {
                new ControllerVendor.ProductInfo(0x05C4, "DualShock 4 (v1)", ControllerType.PlayStation4),
                new ControllerVendor.ProductInfo(0x09CC, "DualShock 4 (v2)", ControllerType.PlayStation4),
                new ControllerVendor.ProductInfo(0x0CE6, "DualSense (PS5)", ControllerType.PlayStation5),
                new ControllerVendor.ProductInfo(0x0DF2, "DualSense Edge", ControllerType.PlayStation5),
                new ControllerVendor.ProductInfo(0x09D2, "DualShock 4 USB Adapter", ControllerType.PlayStation4),
            }
        ),

        // 🎮 MICROSOFT
        new ControllerVendor(
            0x045E, "Microsoft", ControllerType.XboxOne, new []
            {
                new ControllerVendor.ProductInfo(0x028E, "Xbox 360 Controller", ControllerType.Xbox360),
                new ControllerVendor.ProductInfo(0x02E0, "Xbox One Controller (Launch 2013)", ControllerType.XboxOne),
                new ControllerVendor.ProductInfo(0x02EA, "Xbox One Controller", ControllerType.XboxOne),
                new ControllerVendor.ProductInfo(0x02FD, "Xbox One S Controller", ControllerType.XboxOne),
                new ControllerVendor.ProductInfo(0x0B12, "Xbox Series X/S Controller", ControllerType.XboxSeries),
                new ControllerVendor.ProductInfo(0x02FF, "Xbox Elite Controller v1", ControllerType.XboxOne),
                new ControllerVendor.ProductInfo(0x0B00, "Xbox Elite Controller v2", ControllerType.XboxOne),
            }
        ),

        // 🎮 NINTENDO
        new ControllerVendor(
            0x057E, "Nintendo", ControllerType.NintendoSwitch, new []
            {
                new ControllerVendor.ProductInfo(0x2009, "Switch Pro Controller", ControllerType.NintendoSwitch),
                new ControllerVendor.ProductInfo(0x2006, "Joy-Con (L)", ControllerType.NintendoSwitch),
                new ControllerVendor.ProductInfo(0x2007, "Joy-Con (R)", ControllerType.NintendoSwitch),
                new ControllerVendor.ProductInfo(0x2017, "SNES Controller (Switch Online)", ControllerType.NintendoSwitch),
            }
        ),

        // 🎮 LOGITECH
        new ControllerVendor(
            0x046D, "Logitech", ControllerType.PC, new []
            {
                new ControllerVendor.ProductInfo(0xC216, "F310 Gamepad", ControllerType.Xbox360),
                new ControllerVendor.ProductInfo(0xC218, "F510 Gamepad", ControllerType.Xbox360),
                new ControllerVendor.ProductInfo(0xC21D, "F710 Wireless Gamepad", ControllerType.Xbox360),
                new ControllerVendor.ProductInfo(0xC266, "Extreme 3D Pro Joystick", ControllerType.PC),
            }
        ),

        // 🎮 8BitDo
        new ControllerVendor(
            0x2DC8, "8BitDo", ControllerType.Generic, new []
            {
                new ControllerVendor.ProductInfo(0x6001, "SN30 Pro+", ControllerType.NintendoSwitch),
                new ControllerVendor.ProductInfo(0x6002, "Pro 2", ControllerType.PlayStation4),
                new ControllerVendor.ProductInfo(0x9000, "Ultimate Controller (2.4g)", ControllerType.XboxOne),
            }
        ),

        // 🎮 HORI
        new ControllerVendor(
            0x0F0D, "Hori", ControllerType.Generic, new []
            {
                new ControllerVendor.ProductInfo(0x00EE, "Fighting Commander 4", ControllerType.PlayStation4),
                new ControllerVendor.ProductInfo(0x00F6, "Fighting Commander OCTA", ControllerType.PlayStation5),
                new ControllerVendor.ProductInfo(0x009C, "Switch Horipad", ControllerType.NintendoSwitch),
            }
        ),

        // 🎮 PDP
        new ControllerVendor(
            0x0E6F, "PDP", ControllerType.Generic, new []
            {
                new ControllerVendor.ProductInfo(0x02A4, "Afterglow Xbox One Controller", ControllerType.XboxOne),
                new ControllerVendor.ProductInfo(0x0146, "Rock Candy Xbox 360 Controller", ControllerType.Xbox360),
                new ControllerVendor.ProductInfo(0x02AB, "Victrix Pro BFG (PS5)", ControllerType.PlayStation5),
            }
        ),

        // 🎮 Generic USB
        new ControllerVendor(
            0x0810, "Generic", ControllerType.Generic, new []
            {
                new ControllerVendor.ProductInfo(0x0001, "Generic HID Gamepad", ControllerType.Generic),
                new ControllerVendor.ProductInfo(0xE501, "PC Twin Shock Controller", ControllerType.PlayStation3),
                new ControllerVendor.ProductInfo(0x0003, "USB Gamepad (Clone)", ControllerType.Generic),
            }
        ),

        // 🎮 VALVE / STEAM
        new ControllerVendor(
            0x28DE, "Valve", ControllerType.Steam, new []
            {
                new ControllerVendor.ProductInfo(0x1102, "Steam Controller", ControllerType.Steam),
                new ControllerVendor.ProductInfo(0x1205, "Steam Deck Controller Interface", ControllerType.Steam),
                new ControllerVendor.ProductInfo(0x1142, "Steam Deck (Bluetooth HID)", ControllerType.Steam),
            }
        ),
    };

    // --- 🔍 Lookup Methods ---
    public static string GetControllerName(int vendorId, int productId, out ControllerType type)
    {
        foreach (var vendor in Vendors)
        {
            if (vendor.VendorId == vendorId)
            {
                foreach (var product in vendor.Products)
                {
                    if (product.ProductId == productId)
                    {
                        type = product.Type;
                        return $"{vendor.VendorName} {product.ProductName}";
                    }
                }

                type = vendor.DefaultType;
                return $"{vendor.VendorName} (Unknown Product 0x{productId:X4})";
            }
        }

        type = ControllerType.Unknown;
        return $"Unknown Vendor 0x{vendorId:X4}, Product 0x{productId:X4}";
    }

    public static string GetControllerName(Guid productGuid, out ControllerType type)
    {
           byte[] guidBytes = productGuid.ToByteArray();
            ushort vendorId = (ushort)((guidBytes[1] << 8) | guidBytes[0]); 
            ushort productId = (ushort)((guidBytes[3] << 8) | guidBytes[2]);
        return GetControllerName(vendorId, productId, out type);
    }

    public static string GetControllerName(Joystick joystick, out ControllerType type)
        => GetControllerName(joystick.Information.ProductGuid, out type);
}

}
# ---------- end c_gp_types ----------
panel = Panel(c_sdl3.out)
panel_2 = Panel(c_state.out)
panel_3 = Panel(c_gamepad_type.a)
panel_4 = Panel(c_gp_types.out)
panel_5 = Panel(c_gp_types.a)
panel_6 = Panel(c_state.a)
c_script = CSharpScript(y=Button())  # -> out, a; disabled
# ---------- c_script: C# ----------
#r "nuget: SharpDX.DirectInput, 4.2.0"
#r "nuget: SharpDX, 4.2.0"

// Grasshopper Script Instance
#region Usings
using System;
using System.Linq;
using System.Collections;
using System.Collections.Generic;
using System.Drawing;

using Rhino;
using Rhino.Geometry;

using Grasshopper;
using Grasshopper.Kernel;
using Grasshopper.Kernel.Data;
using Grasshopper.Kernel.Types;
   using SharpDX.DirectInput;
#endregion

public class Script_Instance : GH_ScriptInstance
{
    Joystick _joystick = null;

    private void RunScript(object x, object y, ref object a)
    {
       if(_joystick == null)
       GetJoystick();

        // Read current state
        var state = _joystick.GetCurrentState();

        if (state == null)
        {
            Console.WriteLine("Failed to read joystick state.");
            return;
        }
 
        // Axes
        Console.WriteLine($"X: {state.X}, Y: {state.Y}, Z: {state.Z}");
        Console.WriteLine($"Rotation X: {state.RotationX}, Y: {state.RotationY}, Z: {state.RotationZ}");

        // Buttons
        var buttons = state.Buttons;
        for (int i = 0; i < buttons.Length; i++)
        {
            if (buttons[i])
                Console.WriteLine($"Button {i} pressed");
        }

        // Hat (D-Pad)
        var povs = state.PointOfViewControllers;
        foreach (var pov in povs)
        {
            Console.WriteLine($"D-Pad (POV): {pov}"); // -1 if not pressed, otherwise angle in degrees
        }
        

        a=state;
    }


    void GetJoystick()
    {
        var directInput = new DirectInput();



        // Find a connected game controller
        var devices = directInput.GetDevices(DeviceClass.GameControl, DeviceEnumerationFlags.AttachedOnly);
        if (!devices.Any())
            throw new InvalidOperationException("No game control devices found.");

        // Pick the first one
        var deviceInstance = devices.First();
        Console.WriteLine("Using device: " + deviceInstance.ProductName);

        // Create joystick
        _joystick = new Joystick(directInput, deviceInstance.InstanceGuid);

        // Acquire the device
        _joystick.Properties.BufferSize = 128;
        _joystick.Acquire();
    }
}
# ---------- end c_script ----------
panel_7 = Panel(c_script.out)
panel_8 = Panel(c_script.a)
