# Grasshopper definition MeshIntersection.gh (Grasshopper 1.0.8)
# plug-ins: MetaHopper

number_slider = Slider(1.7, range=0..10)
mesh = Mesh(<mesh referenced from the Rhino model>)
pt = Point(Point(40.20074135, -8.008562926, -5.834667403))

preview = CustomPreview(Geometry=mesh, Material=ColourSwatch(SwatchColor=RGB(143, 143, 143)))
toggle = GroupToggle(ToggleActive=True, ToggleVisible=False)  # disabled

c_script = CSharpScript(pos=pt, colMsh=mesh, eyeHeight=number_slider)  # -> out, Pos; inputs pos: Point3d, colMsh: Mesh, eyeHeight: Double
# ---------- c_script: C# ----------
// Grasshopper Script Instance
#region Usings
using System;
using System.Linq;
using System.Collections;
using System.Collections.Generic;
using System.Drawing;

using Rhino;
using Rhino.Geometry;

using Grasshopper;
using Grasshopper.Kernel;
using Grasshopper.Kernel.Data;
using Grasshopper.Kernel.Types;
#endregion

public class Script_Instance : GH_ScriptInstance
{
    #region Notes
    /* 
      Members:
        RhinoDoc RhinoDocument
        GH_Document GrasshopperDocument
        IGH_Component Component
        int Iteration

      Methods (Virtual & overridable):
        Print(string text)
        Print(string format, params object[] args)
        Reflect(object obj)
        Reflect(object obj, string method_name)
    */
    #endregion

    private void RunScript(
		Point3d pos,
		Mesh colMsh,
		double eyeHeight,
		ref object Pos)
    {
        Ray3d ray = new Ray3d(pos, -Vector3d.ZAxis);
        double distance  = Rhino.Geometry.Intersect.Intersection.MeshRay(colMsh, ray);

        if (distance> 0)
        {
            pos.Z -= distance - eyeHeight;
        }else
        {
           pos = colMsh.ClosestPoint(pos);
           pos.Z += eyeHeight;
        }
        
        Pos=pos;
    }
}
# ---------- end c_script ----------
c_script_2 = CSharpScript(pos=c_script.Pos, colMsh=mesh, eyeHeight=number_slider, isUp=Toggle(True))  # -> out, Pos, nextUp, nextDown, Pts, Col; inputs pos: Point3d, colMsh: Mesh, eyeHeight: Double, isUp: Boolean
# ---------- c_script_2: C# ----------
// Grasshopper Script Instance

using System;
using System.Linq;
using System.Collections;
using System.Collections.Generic;
using System.Drawing;

using Rhino;
using Rhino.Geometry;
using Rhino.Geometry.Intersect;

using Grasshopper;
using Grasshopper.Kernel;
using Grasshopper.Kernel.Data;
using Grasshopper.Kernel.Types;


public class Script_Instance : GH_ScriptInstance
{
    private void RunScript(
		Point3d pos,
		Mesh colMsh,
		double eyeHeight,
		bool isUp,
		ref object Pos,
		ref object nextUp,
		ref object nextDown,
		ref object Pts,
		ref object Col)
    {
        Ray3d ray = new Ray3d(pos, -Vector3d.ZAxis);

        Point3d[] pts  =Intersection.ProjectPointsToMeshes(new Mesh[]{colMsh}, new Point3d[]{pos},Vector3d.ZAxis,0.1);

        List<double> lst = new List<double>();

        for (int i =0; i<pts.Length;i++)
        {
            Point3d pt = pts[i];      
            double dist = pt.DistanceTo(pos);

            if (pt.Z>pos.Z )
            {
                if(isUp)
                    lst.Add(dist);
            }else if(!isUp) //isdown
                lst.Add(dist);
        }

        lst.Sort();

        Color col = (isUp) ? Color.Green : Color.Blue;
        double next =(isUp) ? GetNextUp( lst,  eyeHeight): GetNextDown( lst,  eyeHeight);

        pos.Z += next;

        nextUp = lst;
        Pos= pos;
        Pts=pts;
        Col = col;
    }

    double GetNextDown(List<double> lst, double eyeHeight)
    {
        for (int i =1; i<lst.Count;i++)
        {
            double height = lst[i];

            double addedHeight =  -height+eyeHeight; 
            double dist = height - lst[i-1];

            if(dist<=eyeHeight)
                continue;

            return addedHeight;
        }
        return 0;
    }

    double GetNextUp(List<double> lst, double eyeHeight)
    {
        for (int i =0; i<lst.Count;i++)
        {
            double height = lst[i];

            double addedHeight =  height+eyeHeight;

            if(i== lst.Count-1)
                return addedHeight;

            double dist = lst[i+1]-height;

            if(dist<=eyeHeight)
                continue;

            return addedHeight;
        }
        return 0;
    }
}
# ---------- end c_script_2 ----------

# ----
# human
Z = UnitZ(Factor=number_slider)  # -> expr("-x", UnitVector)
move = Move(Geometry=c_script.Pos, Motion=Z)  # -> Geometry, Transform
sph = Sphere(Base=c_script.Pos, Radius=0.2)
cyl = Cylinder(Base=move.Geometry, Radius=0.1, Length=number_slider)
preview_2 = CustomPreview(Geometry=[sph, cyl], Material=ColourSwatch(SwatchColor=RGB(255, 191, 0)))

data = Data(c_script_2.Pos)
data_2 = Data(c_script_2.nextUp)

# ----
# human
Z_2 = UnitZ(Factor=number_slider)  # -> expr("-x", UnitVector)
move_2 = Move(Geometry=c_script_2.Pos, Motion=Z_2)  # -> Geometry, Transform
sph_2 = Sphere(Base=c_script_2.Pos, Radius=0.2)
cyl_2 = Cylinder(Base=move_2.Geometry, Radius=0.1, Length=number_slider)
preview_3 = CustomPreview(Geometry=[sph_2, cyl_2], Material=c_script_2.Col)

panel = Panel(data_2)
