# Grasshopper definition NextViewport.gh (Grasshopper 1.0.8)

c_nextviewport = CSharpScript(x=Button())  # -> out, a
# ---------- c_nextviewport: C# ----------
// Grasshopper Script Instance
#region Usings
using System;
using System.Linq;
using System.Collections;
using System.Collections.Generic;
using System.Drawing;

using Rhino;
using Rhino.Geometry;

using Grasshopper;
using Grasshopper.Kernel;
using Grasshopper.Kernel.Data;
using Grasshopper.Kernel.Types;
#endregion

public class Script_Instance : GH_ScriptInstance
{
    #region Notes
    /* 
      Members:
        RhinoDoc RhinoDocument
        GH_Document GrasshopperDocument
        IGH_Component Component
        int Iteration

      Methods (Virtual & overridable):
        Print(string text)
        Print(string format, params object[] args)
        Reflect(object obj)
        Reflect(object obj, string method_name)
    */
    #endregion

    private void RunScript(object x, object y, ref object a)
    {


        var views = RhinoDoc.ActiveDoc.Views.ToList().ToArray();
        var active = RhinoDoc.ActiveDoc.Views.ActiveView;

        int index = Array.IndexOf(views, active);

        // clockwise = go backwards
        int prev = (index - 1 + views.Length) % views.Length;

        RhinoDoc.ActiveDoc.Views.ActiveView = views[prev];
        views[prev].Redraw();

    }
}
# ---------- end c_nextviewport ----------
