# Grasshopper definition bmpOnViewport.gh (Grasshopper 1.0.8)

panel = Panel("C:\Git\Daxs\Resources\daxsLogo.png")
c_script = CSharpScript(pth=panel, vx=Slider(100, range=0..100), vy=Slider(44, range=0..100), play=Toggle(False))  # -> out, a; inputs pth: String, vx: Double, vy: Double, play: Boolean
# ---------- c_script: C# ----------
using System;
using System.Diagnostics;
using System.Drawing;
using Rhino;
using Rhino.Display;
using Rhino.Geometry;

public class Script_Instance : GH_ScriptInstance
{

  // Persist across solves
  static AnimatedBitmapConduit _conduit;
  static Guid _vpId = Guid.Empty;
  static Stopwatch _sw = new Stopwatch();
  static double _lastT = 0.0;
  static double _x = 50, _y = 50;  
  static Vector2d _vel = new Vector2d(200, 120);

    private void RunScript(
		string pth,
		double vx,
		double vy,
		bool play,
		ref object a)
    {
        var doc = RhinoDoc.ActiveDoc;
        var view = doc.Views.ActiveView;

        if (_conduit == null)
        {
            _conduit?.DisableAndDispose();
            _vpId = view.ActiveViewportID;
            _conduit = new AnimatedBitmapConduit(pth, _vpId);
            _x = 50; _y = 50;
            _conduit.SetPosition(_x, _y);
            _sw.Reset(); _lastT = 0.0;
            _conduit.Enabled = true;
            doc.Views.Redraw();
        }

        // Update velocity
        _vel = new Vector2d(vx, vy);

        if (play)
        {
            if (!_sw.IsRunning) 
            { 
                _sw.Start(); 
                _lastT = _sw.Elapsed.TotalSeconds; 
            }

            // Advance animation
            double t = _sw.Elapsed.TotalSeconds;
            double dt = t - _lastT; _lastT = t;

            Step(dt, view);
            _conduit.SetPosition(_x, _y);
            doc.Views.Redraw();

            GrasshopperDocument?.ScheduleSolution(16, d => this.Component.ExpireSolution(false));
        }
        else
        {
            if (_sw.IsRunning) 
                _sw.Stop(); // pause where it is
        }

        a = $"pos=({(int)_x},{(int)_y}) vel=({vx},{vy})";
    }

    // Move and bounce within the viewport bounds
    void Step(double dt, RhinoView view)
    {
        _x += _vel.X * dt;
        _y += _vel.Y * dt;

        var bounds = view.ActiveViewport.Bounds;
        int w = _conduit.BitmapWidth;
        int h = _conduit.BitmapHeight;

        if (_x < 0) { _x = 0; _vel = new Vector2d(Math.Abs(_vel.X), _vel.Y); }
        if (_y < 0) { _y = 0; _vel = new Vector2d(_vel.X, Math.Abs(_vel.Y)); }
        if (_x + w > bounds.Width) { _x = bounds.Width - w; _vel = new Vector2d(-Math.Abs(_vel.X), _vel.Y); }
        if (_y + h > bounds.Height){ _y = bounds.Height - h; _vel = new Vector2d(_vel.X, -Math.Abs(_vel.Y)); }
    }

    // Conduit that draws only in the chosen viewport
    public class AnimatedBitmapConduit : DisplayConduit, IDisposable
    {
        public string ImagePath { get; private set; }
        
        DisplayBitmap _bitmap;
        double _x, _y;
        readonly Guid _targetVpId;

        public int BitmapWidth  => _bitmap?.Size.Width  ?? 0;
        public int BitmapHeight => _bitmap?.Size.Height ?? 0;

        public AnimatedBitmapConduit(string filepath, Guid targetViewportId)
        {
            ImagePath = filepath;
            
            using (var bmp = (Bitmap)Image.FromFile(filepath))
            
            _bitmap = new DisplayBitmap(bmp);
            _targetVpId = targetViewportId;
        }

        public void SetPosition(double x, double y) 
        { 
            _x = x; 
            _y = y; 
        }

        protected override void DrawForeground(DrawEventArgs e)
        {
            if (e.Viewport.Id != _targetVpId) 
                return;
        
            if (_bitmap == null) 
                return;
            
            e.Display.DrawBitmap(_bitmap, (int)_x, (int)_y); // native size
        }

        public void DisableAndDispose() 
        { 
            Enabled = false; 
            Dispose(); 
        }

        public void Dispose() 
        { 
            _bitmap?.Dispose(); 
            _bitmap = null; 
        }
    }
}
# ---------- end c_script ----------
c_script_2 = CSharpScript(pth=panel, vx=Slider(33, range=0..100), vy=Slider(100, range=0..100), play=Toggle(False))  # -> out, a; inputs pth: String, vx: Double, vy: Double, play: Boolean; disabled
# ---------- c_script_2: C# ----------
using System;
using System.Diagnostics;
using System.Drawing;
using Rhino;
using Rhino.Display;
using Rhino.Geometry;

public class Script_Instance : GH_ScriptInstance
{

  // Persist across solves
  static AnimatedBitmapConduit _conduit;
  static Guid _vpId = Guid.Empty;
  static Stopwatch _sw = new Stopwatch();
  static double _lastT = 0.0;
  static double _x = 50, _y = 50;           // start position (px)
  static Vector2d _vel = new Vector2d(200, 120);

    private void RunScript(
		string pth,
		double vx,
		double vy,
		bool play,
		ref object a)
    {
        var doc = RhinoDoc.ActiveDoc;
        var view = doc?.Views?.ActiveView;
        if (view == null || string.IsNullOrWhiteSpace(pth)) { a = "No view or path."; return; }

        // (Re)create conduit if missing or image path changed
        if (_conduit == null || _conduit.ImagePath != pth)
        {
        _conduit?.DisableAndDispose();
        _vpId = view.ActiveViewportID;
        _conduit = new AnimatedBitmapConduit(pth, _vpId);
        _x = 50; _y = 50;
        _conduit.SetPosition(_x, _y);
        _sw.Reset(); _lastT = 0.0;
        _conduit.Enabled = true;
        doc.Views.Redraw();
        }

        // Update velocity
        _vel = new Vector2d(vx, vy);

        if (play)
        {
        if (!_sw.IsRunning) { _sw.Start(); _lastT = _sw.Elapsed.TotalSeconds; }

        // Advance animation
        double t = _sw.Elapsed.TotalSeconds;
        double dt = t - _lastT; _lastT = t;

        Step(dt, view);
        _conduit.SetPosition(_x, _y);
        doc.Views.Redraw();

        GrasshopperDocument?.ScheduleSolution(16, d => this.Component.ExpireSolution(false));
        }
        else
        {
        if (_sw.IsRunning) _sw.Stop(); // pause where it is
        }

        a = $"pos=({(int)_x},{(int)_y}) vel=({vx},{vy})";
    }

// Move and bounce within the viewport bounds
  void Step(double dt, RhinoView view)
  {
    _x += _vel.X * dt;
    _y += _vel.Y * dt;

    var bounds = view.ActiveViewport.Bounds;
    int w = _conduit.BitmapWidth;
    int h = _conduit.BitmapHeight;

    if (_x < 0) { _x = 0; _vel = new Vector2d(Math.Abs(_vel.X), _vel.Y); }
    if (_y < 0) { _y = 0; _vel = new Vector2d(_vel.X, Math.Abs(_vel.Y)); }
    if (_x + w > bounds.Width) { _x = bounds.Width - w; _vel = new Vector2d(-Math.Abs(_vel.X), _vel.Y); }
    if (_y + h > bounds.Height){ _y = bounds.Height - h; _vel = new Vector2d(_vel.X, -Math.Abs(_vel.Y)); }
  }

    // Conduit that draws only in the chosen viewport
  public class AnimatedBitmapConduit : DisplayConduit, IDisposable
  {
    public string ImagePath { get; private set; }
    DisplayBitmap _bitmap;
    double _x, _y;
    readonly Guid _targetVpId;

    public int BitmapWidth  => _bitmap?.Size.Width  ?? 0;
    public int BitmapHeight => _bitmap?.Size.Height ?? 0;

    public AnimatedBitmapConduit(string filepath, Guid targetViewportId)
    {
      ImagePath = filepath;
      using (var bmp = (Bitmap)Image.FromFile(filepath))
        _bitmap = new DisplayBitmap(bmp);
      _targetVpId = targetViewportId;
    }

    public void SetPosition(double x, double y) { _x = x; _y = y; }

    protected override void DrawForeground(DrawEventArgs e)
    {
      if (e.Viewport.Id != _targetVpId) return;
      if (_bitmap == null) return;
      e.Display.DrawBitmap(_bitmap, (int)_x, (int)_y); // native size
    }

    public void DisableAndDispose() { Enabled = false; Dispose(); }
    public void Dispose() { _bitmap?.Dispose(); _bitmap = null; }
  }
}
# ---------- end c_script_2 ----------
c_script_3 = CSharpScript(pth=panel)  # -> out, b, a; inputs pth: String; disabled
# ---------- c_script_3: C# ----------
// Grasshopper Script Instance
using System;
using System.Diagnostics;
using System.Drawing;
using Rhino;
using Rhino.Display;
using Rhino.Geometry;
public class Script_Instance : GH_ScriptInstance
{
    


    private void RunScript(string pth, ref object b, ref object a)
    {
       var conduit = new BitmapConduit(
        pth,
        new Point2d(50, 50), // pixels from top-left of viewport
        200, 200
    );
    conduit.Enabled = true;
    RhinoDoc doc = RhinoDoc.ActiveDoc;
    doc.Views.Redraw();
    }

    public class BitmapConduit : DisplayConduit
    {
        private readonly DisplayBitmap _bitmap;
        private readonly Point2d _screenLocation;
        private readonly int _width;
        private readonly int _height;

        public BitmapConduit(string filepath, Point2d screenLocation, int width, int height)
        {
            Bitmap bmp=  (Bitmap)Image.FromFile(filepath);
            _bitmap = new DisplayBitmap(bmp);
            _screenLocation = screenLocation;
            _width = width;
            _height = height;
        }

        protected override void DrawForeground(DrawEventArgs e)
        {
            if(e.Viewport.Id !=RhinoDoc.ActiveDoc.Views.ActiveView.ActiveViewportID)
                return;
            
            e.Display.DrawBitmap(
                _bitmap,
                (int)_screenLocation.X, (int)_screenLocation.Y
            );
        }
    }
}
# ---------- end c_script_3 ----------
panel_2 = Panel(c_script_2.out)
