# Grasshopper definition execute Commands.gh (Grasshopper 1.0.8)

c_keyboard = CSharpScript(RUN=Button(), RESET=Button())  # -> out, a; inputs RUN: Boolean, RESET: Boolean
# ---------- c_keyboard: C# ----------
// Grasshopper Script Instance
using System;
using System.Timers;
using System.Linq;
using System.Collections;
using System.Collections.Generic;
using System.Drawing;
using Rhino;
using Rhino.Geometry;
using Grasshopper;
using Grasshopper.Kernel;
using Grasshopper.Kernel.Data;
using Grasshopper.Kernel.Types;


//Script notices when f1 is pressed and writes something inside the command line. LB

public class Script_Instance : GH_ScriptInstance
{
    // https://msdn.microsoft.com/en-us/library/windows/desktop/dd375731(v=vs.85).aspx

    private const int VK_F1 = 0x70;
    private bool keysHooked = false;
    private static bool debounce = false;
    private static Timer debounceTimer;

    private void RunScript(bool RUN, bool RESET, ref object a)
    {
        if(RESET)
            Reset();

        if(!RUN)
            return;

        if(!keysHooked)
        {
            RhinoApp.KeyboardEvent += OnRhinoKeyboardEvent;
            keysHooked = true;

            debounceTimer = new Timer(500); // 500 ms debounce window
            debounceTimer.Elapsed += OnDebounceTimerElapsed;
            debounceTimer.AutoReset = false;

            RhinoApp.WriteLine("keys Hooked");
        }  
    }

    void Reset()
    {
        RhinoApp.KeyboardEvent -= OnRhinoKeyboardEvent;
        keysHooked = false;
        debounce = false;

        if (debounceTimer != null)
        {
            debounceTimer.Stop();
            debounceTimer.Dispose();
        }

        RhinoApp.WriteLine("key reset");
    }

    static void OnDebounceTimerElapsed(object sender, ElapsedEventArgs e)
    {
        debounce = false;
    }

    static void OnRhinoKeyboardEvent(int key)
    {
        if (key == VK_F1 && !debounce)
        {
            debounce = true;
            RhinoApp.WriteLine("F1 Triggered");

            debounceTimer?.Start();
        }
    }
}
# ---------- end c_keyboard ----------
c_simulate_key = CSharpScript(RUN=Button(), RESET=Button())  # -> out, a; inputs RUN: Boolean, RESET: Boolean
# ---------- c_simulate_key: C# ----------
// Grasshopper Script Instance



using System;
using System.Timers;
using System.Linq;
using System.Collections;
using System.Collections.Generic;
using System.Drawing;
using Rhino;
using Rhino.Geometry;
using Grasshopper;
using Grasshopper.Kernel;
using Grasshopper.Kernel.Data;
using Grasshopper.Kernel.Types;
using System.Runtime.InteropServices;


//Script notices when f1 is pressed and writes something inside the command line. LB

public class Script_Instance : GH_ScriptInstance
{
    // https://msdn.microsoft.com/en-us/library/windows/desktop/dd375731(v=vs.85).aspx

    private const int VK_F1 = 0x70;
    private const int VK_D =0x44;
    private bool keysHooked = false;
    private static bool debounce = false;
    private static Timer debounceTimer;

    [DllImport("user32.dll", SetLastError = true)]
    private static extern void keybd_event(byte bVk, byte bScan, uint dwFlags, UIntPtr dwExtraInfo);
    private const int KEYEVENTF_KEYDOWN = 0x0000;
    private const int KEYEVENTF_KEYUP = 0x0002;
    private const byte VK_TAB = 0x09;

    private void RunScript(bool RUN, bool RESET, ref object a)
    {
        if(RESET)
            Reset();

        if(!RUN)
            return;

        if(!keysHooked)
        {
            RhinoApp.KeyboardEvent += OnRhinoKeyboardEvent;
            keysHooked = true;

            debounceTimer = new Timer(500); // 500 ms debounce window
            debounceTimer.Elapsed += OnDebounceTimerElapsed;
            debounceTimer.AutoReset = false;

            RhinoApp.WriteLine("keys Hooked");
        }  
    }

    void Reset()
    {
        RhinoApp.KeyboardEvent -= OnRhinoKeyboardEvent;
        keysHooked = false;
        debounce = false;

        if (debounceTimer != null)
        {
            debounceTimer.Stop();
            debounceTimer.Dispose();
        }

        RhinoApp.WriteLine("key reset");
    }

    static void OnDebounceTimerElapsed(object sender, ElapsedEventArgs e)
    {
        debounce = false;
    }

    static void OnRhinoKeyboardEvent(int key)
    {
        if (key == VK_D && !debounce)
        {
            debounce = true;
            RhinoApp.WriteLine("F1 Triggered");

                    // Simulate TAB key press and release
            keybd_event(VK_TAB, 0, KEYEVENTF_KEYDOWN, UIntPtr.Zero);
            keybd_event(VK_TAB, 0, KEYEVENTF_KEYUP, UIntPtr.Zero);

            debounceTimer?.Start();
        }
    }
}
# ---------- end c_simulate_key ----------
c_script = CSharpScript(RUN=Button())  # -> out, a; inputs RUN: Boolean
# ---------- c_script: C# ----------
// Grasshopper Script Instance
#region Usings
using System;
using System.Linq;
using System.Collections;
using System.Collections.Generic;
using System.Drawing;

using Rhino;
using Rhino.Geometry;

using Grasshopper;
using Grasshopper.Kernel;
using Grasshopper.Kernel.Data;
using Grasshopper.Kernel.Types;
#endregion

public class Script_Instance : GH_ScriptInstance
{
    #region Notes
    /* 
      Members:
        RhinoDoc RhinoDocument
        GH_Document GrasshopperDocument
        IGH_Component Component
        int Iteration

      Methods (Virtual & overridable):
        Print(string text)
        Print(string format, params object[] args)
        Reflect(object obj)
        Reflect(object obj, string method_name)
    */
    #endregion

    private void RunScript(bool RUN, object y, ref object a)
    {
        if(!RUN)
            return;

          Rhino.RhinoApp.RunScript("_ViewCaptureToFile", false);
    }
}
# ---------- end c_script ----------
panel = Panel(c_simulate_key.out)
