# Grasshopper definition gamepadTest.gh (Grasshopper 1.0.8)
# plug-ins: Human

dpad_down = Surface(<surface referenced from the Rhino model>)
dpad_right = Surface(<surface referenced from the Rhino model>)
dpad_left = Surface(<surface referenced from the Rhino model>)
gamepad = Surface([<surface referenced from the Rhino model> x2])
dpad_up = Surface(<surface referenced from the Rhino model>)
X = Surface(<surface referenced from the Rhino model>)
Y = Surface(<surface referenced from the Rhino model>)
B = Surface(<surface referenced from the Rhino model>)
A = Surface(<surface referenced from the Rhino model>)
start = Surface(<surface referenced from the Rhino model>)
back = Surface(<surface referenced from the Rhino model>)
l1 = Surface(<surface referenced from the Rhino model>)
l2 = Surface(<surface referenced from the Rhino model>)
l3 = Surface(<surface referenced from the Rhino model>)
r1 = Surface(<surface referenced from the Rhino model>)
r2 = Surface(<surface referenced from the Rhino model>)
r3 = Surface(<surface referenced from the Rhino model>)
guide = Surface(<surface referenced from the Rhino model>)
gamepad_2 = Entwine(
    Branch00=X,
    Branch01=Y,
    Branch02=B,
    Branch03=A,
    Branch04=start,
    Branch05=back,
    Branch06=l1,
    Branch07=l2,
    Branch08=l3,
    Branch09=r1,
    Branch010=r2,
    Branch011=r3,
    Branch012=dpad_up,
    Branch013=dpad_down,
    Branch014=dpad_left,
    Branch015=dpad_right,
    Branch016=guide,
    Branch017=gamepad,
    FlattenInputs=True)  # -> simplify(Result)

geo = Geometry(Tree({0}: [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], {1}: [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], {2}: [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], {3}: [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], {4}: [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], {5}: [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]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))
c_gamepadtest = CSharpScript(run=Toggle(False), PadGeo=geo)  # -> out, GeoPad, GeoPassive, GeoActive, GeoPadSpheres, State; inputs run: Boolean, PadGeo: tree of Brep
# ---------- c_gamepadtest: C# ----------
#r "nuget: SharpDX, 4.2.0"
#r "nuget: SharpDX.XInput, 4.2.0"
#r "C:\Users\leonb\AppData\Roaming\McNeel\Rhinoceros\packages\8.0\daxs\0.1.32-beta+9306\libs\ajXjneQf.netcore\daxs.dll"

using System;
using System.Collections.Generic;
using System.Threading;
using System.Threading.Tasks;
using SharpDX.XInput;

using Rhino;
using Rhino.Geometry;
using Rhino.Display;
using Daxs;

public class Script_Instance : GH_ScriptInstance
{    
    private static CancellationTokenSource _cts;
    private static Status _status = Status.NotInitialized; 
    private GamepadState _state;

    //Buttons
    private DateTime _lastPressedTime;
    private string _displayMessage = "";

    public enum Status
    {
        NotInitialized =0,
        Started =1,
        Stopped =2
    }

    List<Brep>geometryPad = new List<Brep>();
    List<Brep>geometryPassive = new List<Brep>();
    List<Brep>geometryActive = new List<Brep>();

    List<Point3d> pads = null;
    List<Point3d> padCenters = null;
    
    private void RunScript(
		bool run,
		Grasshopper.DataTree<Rhino.Geometry.Brep> PadGeo,
		ref object GeoPad,
		ref object GeoPassive,
		ref object GeoActive,
		ref object GeoPadSpheres,
		ref object State)
    {
        if(_status == Status.NotInitialized && run)
        {
            Initialize();
            Start();
        } else if (_status == Status.Stopped && run)
            Start();
        else if (_status == Status.Started && !run)
            Stop();

        if(_state != null)
            State= _state.ToString();


        geometryPad.Clear();
        geometryPassive.Clear();
        geometryActive.Clear();

        //Set Geometry
        geometryPad.AddRange(PadGeo.Branch(17));

        //X
        if(_state != null &&_state.X)
            geometryActive.AddRange(PadGeo.Branch(0));
        else
            geometryPassive.AddRange(PadGeo.Branch(0));

        //Y
        if(_state != null &&_state.Y)
            geometryActive.AddRange(PadGeo.Branch(1));
        else
            geometryPassive.AddRange(PadGeo.Branch(1));

        //B
        if(_state != null &&_state.B)
            geometryActive.AddRange(PadGeo.Branch(2));
        else
            geometryPassive.AddRange(PadGeo.Branch(2));

        //A
        if(_state != null &&_state.A)
            geometryActive.AddRange(PadGeo.Branch(3));
        else
            geometryPassive.AddRange(PadGeo.Branch(3));

        //Start
        if(_state != null &&_state.Start)
            geometryActive.AddRange(PadGeo.Branch(4));
        else
            geometryPassive.AddRange(PadGeo.Branch(4));

        //Back
        if(_state != null &&_state.Back)
            geometryActive.AddRange(PadGeo.Branch(5));
        else
            geometryPassive.AddRange(PadGeo.Branch(5));

        //L1
        if(_state != null &&_state.L1)
            geometryActive.AddRange(PadGeo.Branch(6));
        else
            geometryPassive.AddRange(PadGeo.Branch(6));

        //L2
        if(_state != null &&_state.L2 >0)
            geometryActive.AddRange(PadGeo.Branch(7));
        else
            geometryPassive.AddRange(PadGeo.Branch(7));

        //L3
        if(_state != null &&_state.L3 )
            geometryActive.AddRange(PadGeo.Branch(8));
        else
            geometryPassive.AddRange(PadGeo.Branch(8));

        //R1
        if(_state != null &&_state.R1)
            geometryActive.AddRange(PadGeo.Branch(9));
        else
            geometryPassive.AddRange(PadGeo.Branch(9));

        //R2
        if(_state != null &&_state.R2 >0)
            geometryActive.AddRange(PadGeo.Branch(10));
        else
            geometryPassive.AddRange(PadGeo.Branch(10));

        //R3
        if(_state != null &&_state.R3 )
            geometryActive.AddRange(PadGeo.Branch(11));
        else
            geometryPassive.AddRange(PadGeo.Branch(11));

        //Dpad Up
        if(_state != null &&_state.DPadUp )
            geometryActive.AddRange(PadGeo.Branch(12));
        else
            geometryPassive.AddRange(PadGeo.Branch(12));

        //Dpad Down
        if(_state != null &&_state.DPadDown )
            geometryActive.AddRange(PadGeo.Branch(13));
        else
            geometryPassive.AddRange(PadGeo.Branch(13));

        //Dpad Left
        if(_state != null &&_state.DPadLeft )
            geometryActive.AddRange(PadGeo.Branch(14));
        else
            geometryPassive.AddRange(PadGeo.Branch(14));

        //Dpad Right
        if(_state != null &&_state.DPadRight )
            geometryActive.AddRange(PadGeo.Branch(15));
        else
            geometryPassive.AddRange(PadGeo.Branch(15));

        //Guide
        geometryPassive.AddRange(PadGeo.Branch(16));

        //LeftPad
        Brep geolPad = PadGeo.Branch(8)[0];
        Brep georPad = PadGeo.Branch(11)[0];

        if(_state != null)
        {
            BoundingBox bBox= geolPad.GetBoundingBox(false);
            Point3d center = bBox.Center;
            center.X += (bBox.Max.X - center.X)* _state.LeftThumbX;
            center.Y += (bBox.Max.Y - center.Y)* _state.LeftThumbY;

            pads[0 ] = center;

            bBox= georPad.GetBoundingBox(false);
            center = bBox.Center;
            center.X += (bBox.Max.X - center.X)* _state.RightThumbX;
            center.Y += (bBox.Max.Y - center.Y)* _state.RightThumbY;

            pads[1 ] = center;
        }

        // L2 trigger visual cue
        if (_state != null)
        {
            Brep geoL2 = PadGeo.Branch(7)[0]; // Geometry for L2
            BoundingBox l2Box = geoL2.GetBoundingBox(false);
            Point3d l2Center = l2Box.Center;
            l2Center.Y += 40 * _state.L2; // Z offset proportional to L2
            pads[2 ] =l2Center; // Add new sphere position
        }

        // R2 trigger visual cue
        if (_state != null)
        {
            Brep geoR2 = PadGeo.Branch(10)[0]; // Geometry for R2
            BoundingBox r2Box = geoR2.GetBoundingBox(false);
            Point3d r2Center = r2Box.Center;
            r2Center.Y += 40 * _state.R2; // Z offset proportional to R2
            pads[3 ] = r2Center; // Add new sphere position
        }

        //Output
        GeoPad =   geometryPad;
        GeoPassive = geometryPassive;
        GeoActive = geometryActive;

        GeoPadSpheres =pads;
    }

    void Initialize() 
    { 
        _state = null;
        geometryPad.Clear();
        geometryPassive.Clear();
        geometryActive.Clear();

        pads = new List<Point3d>()
        {
            new Point3d(), 
            new Point3d(), 
            new Point3d(), 
            new Point3d()  
        };

    
    }

    void Start()
    {
        _cts = new CancellationTokenSource();
        _ = Task.Run(() => Loop(_cts.Token), _cts.Token);
        _status = Status.Started;

        Rhino.Display.DisplayPipeline.DrawForeground += DrawText;    
    }

    void Stop()
    {
        _cts.Cancel();
        _status = Status.Stopped;

        Rhino.Display.DisplayPipeline.DrawForeground -= DrawText;  
    }

    void ExpireSolution()
    {
        var expireAction = new Action<bool>(this.Component.ExpireSolution);
        Grasshopper.Instances.ActiveCanvas.Invoke(expireAction, new object[] { true });
    } 

    #region DISPLAY
    void DrawText(object sender, Rhino.Display.DrawEventArgs e)
    {
        var activeView = Rhino.RhinoDoc.ActiveDoc.Views.ActiveView;
        if (e.Viewport.Id != activeView.MainViewport.Id)
            return;

        var screenPoint = new Point2d(50, 50);
        e.Display.Draw2dText(_displayMessage, System.Drawing.Color.Black, screenPoint, false, 25);
    }
    #endregion 

    IGamepad gamepad = null;

    async Task  Loop( CancellationToken token)
    {
        RhinoDoc doc =RhinoDoc.ActiveDoc; 
        
        while (!token.IsCancellationRequested)
        {  
            if (gamepad == null || !gamepad.IsConnected)
            {
                gamepad = TryGetGamepad();
                if (gamepad == null)
                {
                    RhinoApp.WriteLine("No supported controller found.");
                    await Task.Delay(1000, token);
                    continue;
                }
                else
                {
                    RhinoApp.WriteLine($"Connected to {gamepad.GetType().Name}");
                }
            }

                var state = gamepad.GetState();

                _state = state;

            // Update the camera on the UI thread.
            Rhino.RhinoApp.InvokeOnUiThread((Action)(() =>
            {
                ExpireSolution();
       
            }));

            await Task.Delay(100, token);
        }
    }

    private IGamepad TryGetGamepad()
    {
        // var xbox = new XboxGamepad();
        // if (xbox.IsConnected)
        //     return xbox;

        var ps4 = new PS4Gamepad();
        if (ps4.IsConnected)
           return ps4;

        return null;
    } 
}
# ---------- end c_gamepadtest ----------

panel = Panel(c_gamepadtest.State)
edges = BrepEdges(Brep=c_gamepadtest.GeoPad)  # -> Naked, Interior, NonManifold
preview = CustomPreview(Geometry=c_gamepadtest.GeoPad, Material=ColourSwatch(SwatchColor=RGB(0, 0, 0)))
previewlw = CustomPreviewLineweights(
    Geometry=edges.Naked,
    Shader=ColourSwatch(SwatchColor=RGB(255, 255, 255)),
    Thickness=Slider(2, range=0..10),
    Absolute=False)
preview_2 = CustomPreview(Geometry=c_gamepadtest.GeoPassive, Material=ColourSwatch(SwatchColor=RGB(76, 76, 76)))
preview_3 = CustomPreview(Geometry=c_gamepadtest.GeoActive, Material=ColourSwatch(SwatchColor=RGB(0, 140, 255)))
preview_4 = CustomPreview(Geometry=c_gamepadtest.GeoPadSpheres, Material=ColourSwatch(SwatchColor=RGB(255, 0, 0)))
