# Grasshopper definition ps4.gh (Grasshopper 1.0.8)

# X = B0
# Y = B3
# B = B2
# A = B1
# 
# Back = B8
# Start = B9
# 
# L1 = B4
# L2 = B10 + RotationX (0-65535)
# L3.x = X (0-65535)
# L3.y = Y (0-65535)
# 
# R1 = B5
# R2 = B11 + RotationY (0-65535)
# R3.x = Z (0-65535)
# R3.y = RotationZ (0-65535)
c_state = CSharpScript(y=Button())  # -> out, a
# ---------- c_state: C# ----------
#r "nuget: SharpDX.DirectInput, 4.2.0"
#r "nuget: SharpDX, 4.2.0"

// Grasshopper Script Instance
#region Usings
using System;
using System.Linq;
using System.Collections;
using System.Collections.Generic;
using System.Drawing;

using Rhino;
using Rhino.Geometry;

using Grasshopper;
using Grasshopper.Kernel;
using Grasshopper.Kernel.Data;
using Grasshopper.Kernel.Types;
   using SharpDX.DirectInput;
#endregion

public class Script_Instance : GH_ScriptInstance
{
    Joystick _joystick = null;

    private void RunScript(object x, object y, ref object a)
    {
      if (_joystick == null)
        GetJoystick();

    // Read current state
    var state = _joystick.GetCurrentState();
    if (state == null)
    {
        a = "Failed to read joystick state.";
        return;
    }

    var debug = new System.Text.StringBuilder();

    // Axes
    debug.AppendLine("=== Axes ===");
    debug.AppendLine($"X: {state.X}");
    debug.AppendLine($"Y: {state.Y}");
    debug.AppendLine($"Z: {state.Z}");
    debug.AppendLine($"RotationX: {state.RotationX}");
    debug.AppendLine($"RotationY: {state.RotationY}");
    debug.AppendLine($"RotationZ: {state.RotationZ}");

    // Sliders
    debug.AppendLine("=== Sliders ===");
    foreach (var s in state.Sliders)
        debug.AppendLine($"Slider: {s}");

    // Velocity
    debug.AppendLine("=== Velocity ===");
    debug.AppendLine($"VelocityX: {state.VelocityX}");
    debug.AppendLine($"VelocityY: {state.VelocityY}");
    debug.AppendLine($"VelocityZ: {state.VelocityZ}");
    debug.AppendLine($"AngularVelocityX: {state.AngularVelocityX}");
    debug.AppendLine($"AngularVelocityY: {state.AngularVelocityY}");
    debug.AppendLine($"AngularVelocityZ: {state.AngularVelocityZ}");

    // Acceleration
    debug.AppendLine("=== Acceleration ===");
    debug.AppendLine($"AccelerationX: {state.AccelerationX}");
    debug.AppendLine($"AccelerationY: {state.AccelerationY}");
    debug.AppendLine($"AccelerationZ: {state.AccelerationZ}");
    debug.AppendLine($"AngularAccelerationX: {state.AngularAccelerationX}");
    debug.AppendLine($"AngularAccelerationY: {state.AngularAccelerationY}");
    debug.AppendLine($"AngularAccelerationZ: {state.AngularAccelerationZ}");

    // Force
    debug.AppendLine("=== Force ===");
    debug.AppendLine($"ForceX: {state.ForceX}");
    debug.AppendLine($"ForceY: {state.ForceY}");
    debug.AppendLine($"ForceZ: {state.ForceZ}");
    debug.AppendLine($"TorqueX: {state.TorqueX}");
    debug.AppendLine($"TorqueY: {state.TorqueY}");
    debug.AppendLine($"TorqueZ: {state.TorqueZ}");

    // Buttons
    debug.AppendLine("=== Buttons ===");
    for (int i = 0; i < state.Buttons.Length; i++)
    {
        debug.AppendLine($"Button {i}: {(state.Buttons[i] ? "----------->Pressed" : "Released")}");
    }

    // POV (D-Pad)
    debug.AppendLine("=== POV (D-Pad) ===");
    for (int i = 0; i < state.PointOfViewControllers.Length; i++)
    {
        int pov = state.PointOfViewControllers[i];
        debug.AppendLine($"POV {i}: {(pov == -1 ? "Centered" : pov + "°")}");
    }

    // Output to component
    a = debug.ToString();
    }


    void GetJoystick()
    {
        var directInput = new DirectInput();



        // Find a connected game controller
        var devices = directInput.GetDevices(DeviceClass.GameControl, DeviceEnumerationFlags.AttachedOnly);
        if (!devices.Any())
            throw new InvalidOperationException("No game control devices found.");

        // Pick the first one
        var deviceInstance = devices.First();
        Console.WriteLine("Using device: " + deviceInstance.ProductName);

        // Create joystick
        _joystick = new Joystick(directInput, deviceInstance.InstanceGuid);

        // Acquire the device
        _joystick.Properties.BufferSize = 128;
        _joystick.Acquire();
    }
}
# ---------- end c_state ----------
panel = Panel(c_state.a)
c_script = CSharpScript(y=Button())  # -> out, a; disabled
# ---------- c_script: C# ----------
#r "nuget: SharpDX.DirectInput, 4.2.0"
#r "nuget: SharpDX, 4.2.0"

// Grasshopper Script Instance
#region Usings
using System;
using System.Linq;
using System.Collections;
using System.Collections.Generic;
using System.Drawing;

using Rhino;
using Rhino.Geometry;

using Grasshopper;
using Grasshopper.Kernel;
using Grasshopper.Kernel.Data;
using Grasshopper.Kernel.Types;
   using SharpDX.DirectInput;
#endregion

public class Script_Instance : GH_ScriptInstance
{
    Joystick _joystick = null;

    private void RunScript(object x, object y, ref object a)
    {
       if(_joystick == null)
       GetJoystick();

        // Read current state
        var state = _joystick.GetCurrentState();

        if (state == null)
        {
            Console.WriteLine("Failed to read joystick state.");
            return;
        }
 
        // Axes
        Console.WriteLine($"X: {state.X}, Y: {state.Y}, Z: {state.Z}");
        Console.WriteLine($"Rotation X: {state.RotationX}, Y: {state.RotationY}, Z: {state.RotationZ}");

        // Buttons
        var buttons = state.Buttons;
        for (int i = 0; i < buttons.Length; i++)
        {
            if (buttons[i])
                Console.WriteLine($"Button {i} pressed");
        }

        // Hat (D-Pad)
        var povs = state.PointOfViewControllers;
        foreach (var pov in povs)
        {
            Console.WriteLine($"D-Pad (POV): {pov}"); // -1 if not pressed, otherwise angle in degrees
        }
        

        a=state;
    }


    void GetJoystick()
    {
        var directInput = new DirectInput();



        // Find a connected game controller
        var devices = directInput.GetDevices(DeviceClass.GameControl, DeviceEnumerationFlags.AttachedOnly);
        if (!devices.Any())
            throw new InvalidOperationException("No game control devices found.");

        // Pick the first one
        var deviceInstance = devices.First();
        Console.WriteLine("Using device: " + deviceInstance.ProductName);

        // Create joystick
        _joystick = new Joystick(directInput, deviceInstance.InstanceGuid);

        // Acquire the device
        _joystick.Properties.BufferSize = 128;
        _joystick.Acquire();
    }
}
# ---------- end c_script ----------
panel_2 = Panel(c_script.out)
panel_3 = Panel(c_script.a)
