# Grasshopper definition MeshIntersection.gh (Grasshopper 1.0.8)

pt = Point(Point(-1.637462388, -32.06723053, 28.88543049))
mesh = Mesh(<mesh referenced from the Rhino model>)
c_script = CSharpScript(pos=pt, colMsh=mesh, eyeHeight=Slider(1.7, range=0..10))  # -> out, Pos; inputs pos: Point3d, colMsh: Mesh, eyeHeight: Double
# ---------- c_script: C# ----------
// Grasshopper Script Instance
#region Usings
using System;
using System.Linq;
using System.Collections;
using System.Collections.Generic;
using System.Drawing;

using Rhino;
using Rhino.Geometry;

using Grasshopper;
using Grasshopper.Kernel;
using Grasshopper.Kernel.Data;
using Grasshopper.Kernel.Types;
#endregion

public class Script_Instance : GH_ScriptInstance
{
    #region Notes
    /* 
      Members:
        RhinoDoc RhinoDocument
        GH_Document GrasshopperDocument
        IGH_Component Component
        int Iteration

      Methods (Virtual & overridable):
        Print(string text)
        Print(string format, params object[] args)
        Reflect(object obj)
        Reflect(object obj, string method_name)
    */
    #endregion

    private void RunScript(
		Point3d pos,
		Mesh colMsh,
		double eyeHeight,
		ref object Pos)
    {
        Ray3d ray = new Ray3d(pos, -Vector3d.ZAxis);
        double distance  = Rhino.Geometry.Intersect.Intersection.MeshRay(colMsh, ray);

        if (distance> 0)
        {
            pos.Z -= distance - eyeHeight;
        }else
        {
           pos = colMsh.ClosestPoint(pos);
           pos.Z += eyeHeight;
        }
        
        Pos=pos;
    }
}
# ---------- end c_script ----------
