# Grasshopper definition NextNamedViews.gh (Grasshopper 1.0.8)

c_nextnamedviews = CSharpScript(x=Button())  # -> out, a
# ---------- c_nextnamedviews: C# ----------
// Grasshopper Script Instance
#region Usings
using System;
using System.Linq;
using System.Collections;
using System.Collections.Generic;
using System.Drawing;

using Rhino;
using Rhino.Geometry;
using Rhino.Display;

using Grasshopper;
using Grasshopper.Kernel;
using Grasshopper.Kernel.Data;
using Grasshopper.Kernel.Types;
using Rhino.DocObjects;
#endregion

public class Script_Instance : GH_ScriptInstance
{
    #region Notes
    /* 
      Members:
        RhinoDoc RhinoDocument
        GH_Document GrasshopperDocument
        IGH_Component Component
        int Iteration

      Methods (Virtual & overridable):
        Print(string text)
        Print(string format, params object[] args)
        Reflect(object obj)
        Reflect(object obj, string method_name)
    */
    #endregion

    private void RunScript(object x, object y, ref object a)
    {

 var doc = RhinoDoc.ActiveDoc;
    if (doc == null)
        return;

    var view = doc.Views.ActiveView;
    if (view == null)
        return;

    var namedViews = doc.NamedViews;
    int count = namedViews.Count;
    if (count == 0)
        return;

    var vp = view.ActiveViewport;

    // --- FIND CURRENT INDEX BY NAME ---
    string activeName = vp.Name;  // name of active viewport
    int index = -1;

    for (int i = 0; i < count; i++)
    {
        if (namedViews[i].Name == activeName)
        {
            index = i;
            break;
        }
    }

    // If no match -> start at first named view
    int next = (index == -1) ? 0 : (index + 1) % count;

    // Apply the named view
    ViewInfo target = namedViews[next];
    vp.PushViewInfo(target, false);

    view.Redraw();
    }
}
# ---------- end c_nextnamedviews ----------
