# Grasshopper definition NextDisplazmode.gh (Grasshopper 1.0.8)

c_nextdisplaymode = CSharpScript(x=Button())  # -> out, a
# ---------- c_nextdisplaymode: C# ----------
// Grasshopper Script Instance
#region Usings
using System;
using System.Linq;
using System.Collections;
using System.Collections.Generic;
using System.Drawing;

using Rhino;
using Rhino.Geometry;
using Rhino.Display;

using Grasshopper;
using Grasshopper.Kernel;
using Grasshopper.Kernel.Data;
using Grasshopper.Kernel.Types;
#endregion

public class Script_Instance : GH_ScriptInstance
{
    #region Notes
    /* 
      Members:
        RhinoDoc RhinoDocument
        GH_Document GrasshopperDocument
        IGH_Component Component
        int Iteration

      Methods (Virtual & overridable):
        Print(string text)
        Print(string format, params object[] args)
        Reflect(object obj)
        Reflect(object obj, string method_name)
    */
    #endregion

    private void RunScript(object x, object y, ref object a)
    {


    var view = RhinoDoc.ActiveDoc.Views.ActiveView;
    if (view == null)
        return;

    // The default 3 modes we want to cycle through
    var modes = new[]
    {
        DisplayModeDescription.GetDisplayMode(DisplayModeDescription.WireframeId),
        DisplayModeDescription.GetDisplayMode(DisplayModeDescription.ShadedId),
        DisplayModeDescription.GetDisplayMode(DisplayModeDescription.RenderedId)
    };

 var current = view.ActiveViewport.DisplayMode;
    int index = Array.FindIndex(modes, m => m.Id == current.Id);

    // If not in the first 3 display modes → restart at Wireframe (index 0)
    int next = (index == -1) ? 0 : (index + 1) % modes.Length;

    view.ActiveViewport.DisplayMode = modes[next];
    view.Redraw();

    }
}
# ---------- end c_nextdisplaymode ----------
