# Grasshopper definition NextViews.gh (Grasshopper 1.0.8)

c_nextviews = CSharpScript(x=Button())  # -> out, a
# ---------- c_nextviews: C# ----------
// Grasshopper Script Instance
#region Usings
using System;
using System.Linq;
using System.Collections;
using System.Collections.Generic;
using System.Drawing;

using Rhino;
using Rhino.Geometry;
using Rhino.Display;

using Grasshopper;
using Grasshopper.Kernel;
using Grasshopper.Kernel.Data;
using Grasshopper.Kernel.Types;

#endregion

public class Script_Instance : GH_ScriptInstance
{

private readonly List<(DefinedViewportProjection proj, string name)> planviews =new List<(DefinedViewportProjection, string)>()
{
    (DefinedViewportProjection.Top, "Top"),
    (DefinedViewportProjection.Front, "Front"),
    (DefinedViewportProjection.Right, "Right"),
    (DefinedViewportProjection.Left, "Left"),
    (DefinedViewportProjection.Back, "Back"),
    (DefinedViewportProjection.Bottom, "Bottom")
};

    private readonly List<(DefinedViewportProjection proj, string name)> perspectiveviews =
        new List<(DefinedViewportProjection, string)>()
    {
        (DefinedViewportProjection.Perspective, "Perspective"),
        (DefinedViewportProjection.TwoPointPerspective, "Two Point Perspective")
       
    };

    private int currentIndex = 0;

    private void RunScript(object x, object y, ref object a)
    {
 var doc  = RhinoDoc.ActiveDoc;
        var view = doc?.Views.ActiveView;
        if (view == null) return;

        var vp = view.ActiveViewport;

        bool isPlan = vp.IsPlanView;
        string currentName = vp.Name;

        var list = isPlan ? planviews : perspectiveviews;

        // find index by name
        int currentIndex = 0;
        for (int i = 0; i < list.Count; i++)
        {
            if (list[i].name.Equals(currentName, StringComparison.OrdinalIgnoreCase))
            {
                currentIndex = i;
                break;
            }
        }

        // next projection
        int next = (currentIndex + 1) % list.Count;
        var (proj, name) = list[next];

        vp.SetProjection(proj, name, true);
        view.Redraw();
    }
}
# ---------- end c_nextviews ----------
