# Grasshopper definition xBox.gh (Grasshopper 1.0.8)

number_slider = Slider(0.009, range=0..0.5)
number_slider_2 = Slider(0.038, range=0..0.5)
number_slider_3 = Slider(0.009, range=0..0.5)
number_slider_4 = Slider(0.0002, range=0..0.5)

# ----
# Works
toggle = BooleanToggle(False)
c_analog_value = CSharpScript(STATUS=Button())  # -> out, A, B; inputs STATUS: Boolean; disabled
# ---------- c_analog_value: C# ----------
using System;
using System.Linq;
using System.Collections;
using System.Collections.Generic;
using System.Drawing;

using Rhino;
using Rhino.Geometry;

using Grasshopper;
using Grasshopper.Kernel;
using Grasshopper.Kernel.Data;
using Grasshopper.Kernel.Types;

using System.Threading;
using SharpDX.XInput;

#r "nuget: SharpDX, 4.2.0"
#r "nuget: SharpDX.XInput, 4.2.0"

public class Script_Instance : GH_ScriptInstance
{
    double deadzone = 0.1;

    private void RunScript(bool STATUS, ref object A, ref object B)
    {
        Controller controller = new Controller(UserIndex.One);

        var state = controller.GetState();

        Gamepad pad = state.Gamepad;

        short rx = pad.RightThumbX;
        short ry = pad.RightThumbY;

        double normX = rx / 32767.0;
        double normY = ry / 32767.0;

        normX = Math.Clamp(normX,-1,1);
        normY = Math.Clamp(normY,-1,1);


        string valX,valY;

        if (Math.Abs(normX) < deadzone || Math.Abs(normY) < deadzone)
        {
            valX = "DEADZONE";
            valY = "DEADZONE";
        }else
        {
            valX = normX.ToString();
            valY = normY.ToString();
        }
        

        A = valX;
        B = valY;
    }
}
# ---------- end c_analog_value ----------
c_cross = CSharpScript(STATUS=toggle)  # -> out, A; inputs STATUS: Boolean; disabled
# ---------- c_cross: C# ----------
using System;
using System.Linq;
using System.Collections;
using System.Collections.Generic;
using System.Drawing;

using Rhino;
using Rhino.Geometry;

using Grasshopper;
using Grasshopper.Kernel;
using Grasshopper.Kernel.Data;
using Grasshopper.Kernel.Types;

using System.Threading;
using SharpDX.XInput;

#r "nuget: SharpDX, 4.2.0"
#r "nuget: SharpDX.XInput, 4.2.0"

public class Script_Instance : GH_ScriptInstance
{

// These two fields remain persistent between component updates.
private bool continueLoop = false;

private void RunScript(bool STATUS, ref object A)
{
    Controller controller = new Controller(UserIndex.One);
    // Start the background task if STATUS is true and the task isn't already running.
       if (STATUS && !continueLoop)
    {
        continueLoop = true;

        // Start the background task.
        System.Threading.Tasks.Task.Run(() =>
        {
            Controller controller = new Controller(UserIndex.One);
            while (continueLoop)
            {
                if (controller.IsConnected)
                {
                    var state = controller.GetState();

                    // Check the DPad buttons.
                    bool dUp = (state.Gamepad.Buttons & GamepadButtonFlags.DPadUp) == GamepadButtonFlags.DPadUp;
                    bool dDown = (state.Gamepad.Buttons & GamepadButtonFlags.DPadDown) == GamepadButtonFlags.DPadDown;
                    bool dLeft = (state.Gamepad.Buttons & GamepadButtonFlags.DPadLeft) == GamepadButtonFlags.DPadLeft;
                    bool dRight = (state.Gamepad.Buttons & GamepadButtonFlags.DPadRight) == GamepadButtonFlags.DPadRight;

                    if (dUp || dDown || dLeft || dRight)
                    {
                        // Update the camera on the UI thread.
                        Rhino.RhinoApp.InvokeOnUiThread((Action)(() =>
                        {
                            var view = RhinoDoc.ActiveDoc.Views.ActiveView;
                            if (view != null)
                            {
                                var vp = view.ActiveViewport;
                                Point3d camLoc = vp.CameraLocation;
                                Point3d camTarget = vp.CameraTarget;

                                // Compute a horizontal forward vector (project camera direction on the XY plane)
                                Vector3d forward = camTarget - camLoc;
                                forward.Z = 0;
                                if (forward.Length == 0)
                                    forward = new Vector3d(0, 1, 0);
                                forward.Unitize();

                                // Compute the right vector as the cross of forward and world up (0,0,1)
                                Vector3d right = Vector3d.CrossProduct(forward, Vector3d.ZAxis);
                                if (right.Length == 0)
                                    right = new Vector3d(1, 0, 0);
                                right.Unitize();

                                // Build the translation vector based on the pressed DPad buttons.
                                Vector3d move = Vector3d.Zero;
                                double moveStep = 5.0; // Adjust this value for desired speed

                                if (dUp) move += forward;
                                if (dDown) move -= forward;
                                if (dRight) move += right;
                                if (dLeft) move -= right;
                                move *= moveStep;

                                // Apply the translation to both camera location and target.
                                vp.SetCameraLocation(camLoc + move, false);
                                vp.SetCameraTarget(camTarget + move, false);
                                view.Redraw();
                            }
                        }));
                    }
                }
                Thread.Sleep(20); // Pause briefly to reduce CPU usage and control update speed.
            }
        });
    }
    else if (!STATUS) // If STATUS is false, signal the task to stop.
        continueLoop = false;
    }
}
# ---------- end c_cross ----------
panel = Panel(c_cross.A)
panel_2 = Panel(c_analog_value.B)
panel_3 = Panel(c_analog_value.A)

number_slider_5 = Slider(0.0002, range=0..0.5)
number_slider_6 = Slider(0.2675, range=0..0.5)
number_slider_7 = Slider(300, range=0..300)
world_up_turntable_first_person_no_roll = CSharpScript(
    run=Toggle(False),
    yawSensitivity=number_slider_5,
    pitchSensitivity=number_slider_5,
    deadzone=Slider(0.1851, range=0.0001..1),
    moveSpeed=Slider(1000, range=0..1000))  # -> out, a; inputs run: Boolean, yawSensitivity: Double, pitchSensitivity: Double, deadzone: Double, moveSpeed: Double; disabled
# ---------- world_up_turntable_first_person_no_roll: C# ----------
#r "nuget: SharpDX, 4.2.0"
#r "nuget: SharpDX.XInput, 4.2.0"

using System;
using System.Collections.Generic;
using System.Threading;
using System.Threading.Tasks;
using SharpDX.XInput;

using Rhino;
using Rhino.Geometry;
using Rhino.Display;

public class Script_Instance : GH_ScriptInstance
{    
    private static CancellationTokenSource _cts;
    private static Status _status = Status.NotInitialized; 
    private List<int> _log;
    double _yawSensitivity,_pitchSensitivity,_deadzone,_moveSpeed;

    //Buttons
    private DateTime _lastPressedTime;
    private string _displayMessage = "";

    public enum Status
    {
        NotInitialized =0,
        Started =1,
        Stopped =2
    }

    #region COMPONENT

    private void RunScript(
		bool run,
		double yawSensitivity,
		double pitchSensitivity,
		double deadzone,
		double moveSpeed,
		ref object a)
        {
        _yawSensitivity =yawSensitivity; 
        _pitchSensitivity =pitchSensitivity;
        _deadzone = deadzone;
        _moveSpeed =moveSpeed;

        if(_status == Status.NotInitialized && run)
        {
            Initialize();
            Start();
        } else if (_status == Status.Stopped && run)
            Start();
        else if (_status == Status.Started && !run)
            Stop();

        a= _log;
    }

    void Initialize()
    {
        _log = new List<int>();
    }

    void Start()
    {
        _cts = new CancellationTokenSource();
        _ = Task.Run(() => Loop(_cts.Token), _cts.Token);
        _status = Status.Started;
    }

    void Stop()
    {
        _cts.Cancel();
        _status = Status.Stopped;
    }

    #endregion




    volatile bool _uiUpdatePending = false;
    static Plane camDir = Plane.WorldXY;
    private readonly object _camLock = new();

        // fields
    double yawAcc = 0.0, pitchAcc = 0.0;

    async Task  Loop( CancellationToken token)
    {
        Controller controller = new Controller(UserIndex.One);
        RhinoDoc doc =RhinoDoc.ActiveDoc; 
        
        while (!token.IsCancellationRequested)
        {  
            if (!controller.IsConnected)
            {
                await Task.Delay(1000, token);
                continue;
            }

            var state = controller.GetState().Gamepad;

             // Inputs
            double speedMulti = _moveSpeed;   // planar speed multiplier
            double rotSpeedMulti = _moveSpeed;         // rotation speed multiplier
            double vertical = GetNonLinearTrigger(state.RightTrigger / 255.0)
                            - GetNonLinearTrigger(state.LeftTrigger / 255.0);

            var (yaw, pitch) = NormalizeStick(state.RightThumbX/ 32767.0, state.RightThumbY/ 32767.0);
            var (strafe, forward) = NormalizeStick(state.LeftThumbX/ 32767.0, state.LeftThumbY/ 32767.0);

            bool isVert = Math.Abs(vertical) > 0.02;

            //RhinoApp.WriteLine("yaw: " + yaw + ", pitch: "+ pitch+  ", forward: "+ forward + ", strafe: " +strafe+ ", isVert" + isVert);

            bool hasMoved = yaw != 0 || pitch != 0 || forward != 0 || strafe != 0 || isVert;
 
            //https://chatgpt.com/g/g-p-67e9bd1beeac8191a0f9ff9d384c27a1-xboxcontroller/c/68b7712b-dd7c-8332-bd77-83ef8ed105fc


            // per frame
            if (hasMoved)
            {
                yawAcc   += yaw   * rotSpeedMulti;
                pitchAcc += pitch * rotSpeedMulti;
                pitchAcc = Math.Max(-RhinoMath.ToRadians(85), Math.Min(RhinoMath.ToRadians(85), pitchAcc));

                // forward from yaw/pitch with world-up = +Z
                var cy = Math.Cos(yawAcc);  var sy = Math.Sin(yawAcc);
                var cp = Math.Cos(pitchAcc);var sp = Math.Sin(pitchAcc);

                // Forward (X axis of the plane)
                var fwd = new Vector3d(cp*cy, cp*sy, sp); fwd.Unitize();

                // Right (Y axis of the plane) = normalize( worldUp × fwd )
                var upWorld = Vector3d.ZAxis;
                var right = Vector3d.CrossProduct(upWorld, fwd); right.Unitize();

                // Camera up (Z axis) = fwd × right
                var up = Vector3d.CrossProduct(fwd, right); up.Unitize();

                camDir = new Plane(camDir.Origin, fwd, right); // Plane expects X=fwd, Y=right, Z=up

                // translate in this frame; vertical uses world-up to avoid stair tilt
                Vector3d move = fwd   * forward * speedMulti
                            + right * strafe  * speedMulti
                            + upWorld * vertical;
                camDir.Translate(move);

    
                if (!_uiUpdatePending)
                {
                    _uiUpdatePending = true;

                    // Update the camera on the UI thread.
                    Rhino.RhinoApp.InvokeOnUiThread((Action)(() =>
                    {
                        var view = doc.Views.ActiveView;
                        var vp = view.ActiveViewport;

                        lock (_camLock)
                        {
                            vp.SetCameraLocation(camDir.Origin, true);
                            vp.SetCameraDirection(camDir.XAxis, true);
                        }
            
                        view.Redraw();

                        _uiUpdatePending = false;
                    }));
                }
            }
            
            await Task.Delay(10, token);
        }
    }

    double GetNonLinearTrigger(double raw)=>  Math.Pow(raw, 2); // quadratic curve 

    protected (double x, double y) NormalizeStick(double normX, double normY)
    {
        double magnitude = Math.Sqrt(normX * normX + normY * normY);
        if (magnitude < _deadzone)
            return (0, 0);

        double scaled = Math.Clamp((magnitude - _deadzone) / (1 - _deadzone), 0, 1);

        // Normalize direction
        double dirX = normX / magnitude;
        double dirY = normY / magnitude;

        // Apply sensitivity and scale
        double yaw = -dirX * scaled * _yawSensitivity;
        double pitch = dirY * scaled * _pitchSensitivity;

        return (yaw, pitch);
    }
}
# ---------- end world_up_turntable_first_person_no_roll ----------
free_fly_no_world_up_constraint = CSharpScript(
    run=Toggle(False),
    yawSensitivity=number_slider_6,
    pitchSensitivity=number_slider_6,
    deadzone=Slider(0.1707, range=0.0001..1),
    moveSpeed=Slider(148, range=0..300))  # -> out, a; inputs run: Boolean, yawSensitivity: Double, pitchSensitivity: Double, deadzone: Double, moveSpeed: Double; disabled
# ---------- free_fly_no_world_up_constraint: C# ----------
#r "nuget: SharpDX, 4.2.0"
#r "nuget: SharpDX.XInput, 4.2.0"

using System;
using System.Collections.Generic;
using System.Threading;
using System.Threading.Tasks;
using SharpDX.XInput;

using Rhino;
using Rhino.Geometry;
using Rhino.Display;
using System.Diagnostics;

public class Script_Instance : GH_ScriptInstance
{    
    private static CancellationTokenSource _cts;
    private static Status _status = Status.NotInitialized; 
    private List<int> _log;
    double _yawSensitivity,_pitchSensitivity,_deadzone,_moveSpeed;

    //Buttons
    private DateTime _lastPressedTime;
    private string _displayMessage = "";

    public enum Status
    {
        NotInitialized =0,
        Started =1,
        Stopped =2
    }

    #region COMPONENT

    private void RunScript(
		bool run,
		double yawSensitivity,
		double pitchSensitivity,
		double deadzone,
		double moveSpeed,
		ref object a)
        {
        _yawSensitivity =yawSensitivity; 
        _pitchSensitivity =pitchSensitivity;
        _deadzone = deadzone;
        _moveSpeed =moveSpeed;

        if(_status == Status.NotInitialized && run)
        {
            Initialize();
            Start();
        } else if (_status == Status.Stopped && run)
            Start();
        else if (_status == Status.Started && !run)
            Stop();

        a= _log;
    }

    void Initialize()
    {
        _log = new List<int>();
    }

    void Start()
    {
        _cts = new CancellationTokenSource();
        _ = Task.Run(() => Loop(_cts.Token), _cts.Token);
        _status = Status.Started;
    }

    void Stop()
    {
        _cts.Cancel();
        _status = Status.Stopped;
    }

    #endregion




  // fields (outside Loop)
volatile bool _uiUpdatePending = false;
static Plane camDir = Plane.WorldXY;
readonly object _camLock = new();
readonly Stopwatch _sw = Stopwatch.StartNew();
double _lastT = 0;

// helpers
static double Dead(double v, double dz) => Math.Abs(v) < dz ? 0 : v;
static double Clamp(double v, double lo, double hi) => v < lo ? lo : (v > hi ? hi : v);

async Task Loop(CancellationToken token)
{
    Controller controller = new Controller(UserIndex.One);
    RhinoDoc doc = RhinoDoc.ActiveDoc;

    // tune these separately
    double moveSpeed = _moveSpeed;     // units / sec
    double rotSpeed  = RhinoMath.ToRadians(2.8);      // radians / sec (choose!)
    const double DZ  = 0.12;           // stick deadzone
    const double vertDZ = 0.02;

    while (!token.IsCancellationRequested)
    {
        if (!controller.IsConnected)
        {
            await Task.Delay(1000, token);
            continue;
        }

        var state = controller.GetState().Gamepad;



        // inputs
        double vertical = GetNonLinearTrigger(state.RightTrigger / 255.0)
                        - GetNonLinearTrigger(state.LeftTrigger  / 255.0);

        var (yaw,   pitch)  = NormalizeStick(state.RightThumbX  / 32767.0, state.RightThumbY / 32767.0);
        var (strafe,forward)= NormalizeStick(state.LeftThumbX   / 32767.0, state.LeftThumbY  / 32767.0);

        yaw     = Dead(yaw, DZ);
        pitch   = Dead(pitch, DZ);
        strafe  = Dead(strafe, DZ);
        forward = Dead(forward, DZ);
        bool isVert = Math.Abs(vertical) > vertDZ;

        bool hasMoved = yaw != 0 || pitch != 0 || forward != 0 || strafe != 0 || isVert;

        if (hasMoved)
        {
            lock (_camLock)
            {
                var origin = camDir.Origin;

                // --- 1) Build a single rotation in LOCAL frame ---
                // Capture current local axes
                var up0    = camDir.ZAxis; up0.Unitize();          // local up (Z)
                var right0 = camDir.YAxis; right0.Unitize();       // local right (Y)
                var yawT   = Transform.Rotation(yaw * rotSpeed , up0, origin);

                // Pitch should be about the RIGHT axis **after yaw**:
                var pitchAxis = -right0;                           // local "camera right", sign so +pitch looks up
                pitchAxis.Transform(yawT);                         // rotate axis into yawed frame

                var pitchT  = Transform.Rotation(pitch * rotSpeed , pitchAxis, origin);

                // Compose once; order matters: first yaw, then pitch-in-yawed-frame
                var rotT = pitchT * yawT;

                // Apply rotation to the plane
                camDir.Transform(rotT);

                // --- 2) Re-orthonormalize (Gram–Schmidt) ---
                var x = camDir.XAxis; x.Unitize();                 // forward
                var z = camDir.ZAxis; z.Unitize();                 // up
                var y = Vector3d.CrossProduct(z, x); y.Unitize();  // right
                z = Vector3d.CrossProduct(x, y); z.Unitize();
                camDir = new Plane(camDir.Origin, x, y);           // Plane: X=fwd, Y=right, Z=up

                // --- 3) Translate in updated camera frame (scale by dt) ---
                Vector3d move = camDir.XAxis * (forward * moveSpeed )
                              + camDir.YAxis * (strafe  * moveSpeed )
                              + camDir.ZAxis * (vertical * moveSpeed );
                camDir.Translate(move);
            }
        }

        if (hasMoved && !_uiUpdatePending)
        {
            _uiUpdatePending = true;

            Rhino.RhinoApp.InvokeOnUiThread((Action)(() =>
            {
                Plane snap;
                lock (_camLock) snap = camDir;   // snapshot under the same lock

                var view = doc.Views.ActiveView;
                var vp   = view.ActiveViewport;

                // Use the SNAPSHOT, not camDir (avoids race/jitter)
                vp.SetCameraLocation(snap.Origin,   true);
                vp.SetCameraDirection(snap.XAxis,   true);
                // DO NOT force CameraUp here; free-fly is allowed to roll.

                view.Redraw();
                _uiUpdatePending = false;
            }));
        }

        await Task.Delay(10, token);
    }
}



    double GetNonLinearTrigger(double raw)=>  Math.Pow(raw, 2); // quadratic curve 


    protected (double x, double y) NormalizeStick(double normX, double normY)
    {
        double magnitude = Math.Sqrt(normX * normX + normY * normY);
        if (magnitude < _deadzone)
            return (0, 0);

        double scaled = Math.Clamp((magnitude - _deadzone) / (1 - _deadzone), 0, 1);

        // Normalize direction
        double dirX = normX / magnitude;
        double dirY = normY / magnitude;

        // Apply sensitivity and scale
        double yaw = -dirX * scaled * _yawSensitivity;
        double pitch = dirY * scaled * _pitchSensitivity;

        return (yaw, pitch);
    }
}
# ---------- end free_fly_no_world_up_constraint ----------
panel_4 = Panel(world_up_turntable_first_person_no_roll.a)
panel_5 = Panel(free_fly_no_world_up_constraint.a)

# ----
# FLY
number_slider_8 = Slider(1.5, range=0..3)
world_up_turntable_first_person_no_roll_2 = CSharpScript(
    run=Toggle(False),
    yawSensitivity=number_slider_8,
    pitchSensitivity=number_slider_8,
    deadzone=Slider(0.18, range=0..1),
    moveSpeed=Slider(400, range=0..1500))  # -> out, a; inputs run: Boolean, yawSensitivity: Double, pitchSensitivity: Double, deadzone: Double, moveSpeed: Double; disabled
# ---------- world_up_turntable_first_person_no_roll_2: C# ----------
#r "nuget: SharpDX, 4.2.0"
#r "nuget: SharpDX.XInput, 4.2.0"

using System;
using System.Collections.Generic;
using System.Threading;
using System.Threading.Tasks;
using SharpDX.XInput;

using Rhino;
using Rhino.Geometry;
using Rhino.Display;

public class Script_Instance : GH_ScriptInstance
{    
    private static CancellationTokenSource _cts;
    private static Status _status = Status.NotInitialized; 
    private List<int> _log;
    double _yawSensitivity,_pitchSensitivity,_deadzone,_moveSpeed;

    //Buttons
    private DateTime _lastPressedTime;
    private string _displayMessage = "";

    public enum Status
    {
        NotInitialized =0,
        Started =1,
        Stopped =2
    }

    #region COMPONENT

    private void RunScript(
		bool run,
		double yawSensitivity,
		double pitchSensitivity,
		double deadzone,
		double moveSpeed,
		ref object a)
        {
        _yawSensitivity =yawSensitivity; 
        _pitchSensitivity =pitchSensitivity;
        _deadzone = deadzone;
        _moveSpeed =moveSpeed;

        if(_status == Status.NotInitialized && run)
        {
            Initialize();
            Start();
        } else if (_status == Status.Stopped && run)
            Start();
        else if (_status == Status.Started && !run)
            Stop();

        a= _log;
    }

    void Initialize()
    {
        _log = new List<int>();
    }

    void Start()
    {
        _cts = new CancellationTokenSource();
        _ = Task.Run(() => Loop(_cts.Token), _cts.Token);
        _status = Status.Started;
    }

    void Stop()
    {
        _cts.Cancel();
        _status = Status.Stopped;
    }

    #endregion

    // fields
    volatile bool _uiUpdatePending = false;
    static Plane camPlane;

        // fields
    double yawAcc = 0.0, pitchAcc = 0.0;
    Vector3d zAxis = Vector3d.ZAxis;
    double rad85 = RhinoMath.ToRadians(89);

   async Task Loop(CancellationToken token)
    {
        Controller controller = new Controller(UserIndex.One);
        RhinoDoc doc = RhinoDoc.ActiveDoc;

        //dalta
        var sw = System.Diagnostics.Stopwatch.StartNew();
        long prevTicks = sw.ElapsedTicks;
        double tickToSec = 1.0 / System.Diagnostics.Stopwatch.Frequency;

        // UI throttle accumulator and target interval (~60 FPS)
        double sinceLastUi = 0.0;
        const double uiDt = 1.0 / 60.0;

        while (!token.IsCancellationRequested)
        {
            if (!controller.IsConnected)
            {
                await Task.Delay(1000, token);
                continue;
            }

            long now = sw.ElapsedTicks;
            double dt = (now - prevTicks) * tickToSec;
            
            sinceLastUi += dt;   //  accumulate time for UI throttling

            // clamp to avoid huge jumps 
            if (dt < 1e-5) 
                dt = 1e-5;   // min ~0.01 ms
            if (dt > 0.05) 
                dt = 0.05;   // max 50 ms (~20 FPS)

            prevTicks = now;

            var state = controller.GetState().Gamepad;

            // Inputs
            double speedPerSec     = _moveSpeed;   // units per tick

            double vertical = GetNonLinearTrigger(state.RightTrigger / 255.0)
                            - GetNonLinearTrigger(state.LeftTrigger  / 255.0);

            var (yaw,   pitch)  = NormalizeStick(state.RightThumbX / 32767.0, state.RightThumbY / 32767.0);
            var (strafe,forward)= NormalizeStick(state.LeftThumbX  / 32767.0, state.LeftThumbY  / 32767.0);

            bool isVert  = Math.Abs(vertical) > 0.02;
            bool hasMoved = yaw != 0 || pitch != 0 || forward != 0 || strafe != 0 || isVert;

            if (!hasMoved && !_uiUpdatePending )
            {
                var vp = doc.Views.ActiveView.ActiveViewport;

                // Read current viewport camera
                Vector3d camDir = vp.CameraDirection; 

                // Turntable basis (use world up to remove roll)
                Vector3d right = Vector3d.CrossProduct(zAxis, camDir);
                
                if (!right.Unitize()) 
                    right = Vector3d.XAxis; // guard near poles

                // Update camPlane from viewport
                camPlane = new Plane(vp.CameraLocation, camDir, right);

                // Rebase angle accumulators to match viewport direction
                double newYaw   = Math.Atan2(camDir.Y, camDir.X);
                double newPitch = Math.Asin(camDir.Z);
                
                pitchAcc = GetPitch( newPitch);
                yawAcc   = newYaw;
            }

            if (hasMoved)
            {
                yawAcc   += yaw     *_yawSensitivity*dt;
                pitchAcc += pitch   *_pitchSensitivity* dt ;
                pitchAcc  =  GetPitch( pitchAcc);

                // Rebuild basis from yaw/pitch (turntable, world-up = +Z)
                double cy = Math.Cos(yawAcc);
                double sy = Math.Sin(yawAcc);
                double cp = Math.Cos(pitchAcc);
                double sp = Math.Sin(pitchAcc);

                var fwd = new Vector3d(cp * cy, cp * sy, sp); 
                var right = new Vector3d(-sy, cy, 0);

                Vector3d move = fwd    * (forward * speedPerSec * dt)
                            + right  * (strafe  * speedPerSec * dt)
                            + zAxis* (vertical * speedPerSec * dt);

                camPlane = new Plane(camPlane.Origin + move, fwd, right);
            }

            // --- Push to UI thread ---
        if (hasMoved && sinceLastUi >= uiDt && !_uiUpdatePending)
            {
                _uiUpdatePending = true;
                RhinoApp.InvokeOnUiThread((Action)(() =>
                {
                    try
                    {
                        var view = doc.Views.ActiveView;
                        var vp   = view.ActiveViewport;

                        vp.SetCameraLocation(camPlane.Origin, true);
                        vp.SetCameraDirection(camPlane.XAxis, true);       

                        view.Redraw();
                    }
                    finally
                    {
                        _uiUpdatePending  = false;
                    }
                }));
            }

            await Task.Delay(1, token);
        }
    }


    double GetPitch(double pitchAcc)=> Math.Max(-rad85, Math.Min(rad85, pitchAcc));  // Limit

    double GetNonLinearTrigger(double raw)=>  Math.Pow(raw, 2); // quadratic curve 


    protected (double x, double y) NormalizeStick(double nx, double ny)
    {
        double r2 = nx * nx + ny * ny;
        double dz = _deadzone;
        double dz2 = dz * dz;

        if (r2 <= dz2) 
            return (0, 0);

        double r = Math.Sqrt(r2);
        double invR = 1.0 / r;

        // direction
        double dirX = nx * invR;
        double dirY = ny * invR;

        // scale from deadzone to 1
        double scale = (r - dz) * (1.0 / Math.Max(1e-6, 1.0 - dz));

        double yaw   = -dirX * scale * _yawSensitivity;
        double pitch =  dirY * scale * _pitchSensitivity;
        return (yaw, pitch);
    }
}
# ---------- end world_up_turntable_first_person_no_roll_2 ----------
panel_6 = Panel(world_up_turntable_first_person_no_roll_2.a)

# ----
# WALK
number_slider_9 = Slider(1.5, range=0..3)
world_up_turntable_first_person_no_roll_3 = CSharpScript(
    run=Toggle(False),
    yawSensitivity=number_slider_9,
    pitchSensitivity=number_slider_9,
    deadzone=Slider(0.18, range=0..1),
    moveSpeed=Slider(400, range=0..1500))  # -> out, a; inputs run: Boolean, yawSensitivity: Double, pitchSensitivity: Double, deadzone: Double, moveSpeed: Double
# ---------- world_up_turntable_first_person_no_roll_3: C# ----------
#r "nuget: SharpDX, 4.2.0"
#r "nuget: SharpDX.XInput, 4.2.0"

using System;
using System.Collections.Generic;
using System.Threading;
using System.Threading.Tasks;
using SharpDX.XInput;

using Rhino;
using Rhino.Geometry;
using Rhino.Display;

public class Script_Instance : GH_ScriptInstance
{    
    private static CancellationTokenSource _cts;
    private static Status _status = Status.NotInitialized; 
    private List<int> _log;
    double _yawSensitivity,_pitchSensitivity,_deadzone,_moveSpeed;

    //Buttons
    private DateTime _lastPressedTime;
    private string _displayMessage = "";

    public enum Status
    {
        NotInitialized =0,
        Started =1,
        Stopped =2
    }

    #region COMPONENT

    private void RunScript(
		bool run,
		double yawSensitivity,
		double pitchSensitivity,
		double deadzone,
		double moveSpeed,
		ref object a)
        {
        _yawSensitivity =yawSensitivity; 
        _pitchSensitivity =pitchSensitivity;
        _deadzone = deadzone;
        _moveSpeed =moveSpeed;

        if(_status == Status.NotInitialized && run)
        {
            Initialize();
            Start();
        } else if (_status == Status.Stopped && run)
            Start();
        else if (_status == Status.Started && !run)
            Stop();

        a= _log;
    }

    void Initialize()
    {
        _log = new List<int>();
    }

    void Start()
    {
        _cts = new CancellationTokenSource();
        _ = Task.Run(() => Loop(_cts.Token), _cts.Token);
        _status = Status.Started;
    }

    void Stop()
    {
        _cts.Cancel();
        _status = Status.Stopped;
    }

    #endregion

    // fields
    volatile bool _uiUpdatePending = false;
    static Plane camPlane;

        // fields
    double yawAcc = 0.0, pitchAcc = 0.0;
    Vector3d zAxis = Vector3d.ZAxis;
    double rad85 = RhinoMath.ToRadians(89);

   async Task Loop(CancellationToken token)
    {
        Controller controller = new Controller(UserIndex.One);
        RhinoDoc doc = RhinoDoc.ActiveDoc;

        //dalta
        var sw = System.Diagnostics.Stopwatch.StartNew();
        long prevTicks = sw.ElapsedTicks;
        double tickToSec = 1.0 / System.Diagnostics.Stopwatch.Frequency;

        // UI throttle accumulator and target interval (~60 FPS)
        double sinceLastUi = 0.0;
        const double uiDt = 1.0 / 60.0;

        while (!token.IsCancellationRequested)
        {
            if (!controller.IsConnected)
            {
                await Task.Delay(1000, token);
                continue;
            }

            long now = sw.ElapsedTicks;
            double dt = (now - prevTicks) * tickToSec;
            
            sinceLastUi += dt;   //  accumulate time for UI throttling

            // clamp to avoid huge jumps 
            if (dt < 1e-5) 
                dt = 1e-5;   // min ~0.01 ms
            if (dt > 0.05) 
                dt = 0.05;   // max 50 ms (~20 FPS)

            prevTicks = now;

            var state = controller.GetState().Gamepad;

            // Inputs
            double speedPerSec     = _moveSpeed;   // units per tick

            double vertical = GetNonLinearTrigger(state.RightTrigger / 255.0)
                            - GetNonLinearTrigger(state.LeftTrigger  / 255.0);

            var (yaw,   pitch)  = NormalizeStick(state.RightThumbX / 32767.0, state.RightThumbY / 32767.0);
            var (strafe,forward)= NormalizeStick(state.LeftThumbX  / 32767.0, state.LeftThumbY  / 32767.0);

            bool isVert  = Math.Abs(vertical) > 0.02;
            bool hasMoved = yaw != 0 || pitch != 0 || forward != 0 || strafe != 0 || isVert;

            if (!hasMoved && !_uiUpdatePending )
            {
                var vp = doc.Views.ActiveView.ActiveViewport;

                // Read current viewport camera
                Vector3d camDir = vp.CameraDirection; 

                // Turntable basis (use world up to remove roll)
                Vector3d right = Vector3d.CrossProduct(zAxis, camDir);
                
                if (!right.Unitize()) 
                    right = Vector3d.XAxis; // guard near poles

                // Update camPlane from viewport
                camPlane = new Plane(vp.CameraLocation, camDir, right);

                // Rebase angle accumulators to match viewport direction
                double newYaw   = Math.Atan2(camDir.Y, camDir.X);
                double newPitch = Math.Asin(camDir.Z);
                
                pitchAcc = GetPitch( newPitch);
                yawAcc   = newYaw;
            }

            if (hasMoved)
            {
                yawAcc   += yaw     *_yawSensitivity*dt;
                pitchAcc += pitch   *_pitchSensitivity* dt ;
                pitchAcc  =  GetPitch( pitchAcc);

                // Rebuild basis from yaw/pitch (turntable, world-up = +Z)
                double cy = Math.Cos(yawAcc);
                double sy = Math.Sin(yawAcc);
                double cp = Math.Cos(pitchAcc);
                double sp = Math.Sin(pitchAcc);

                var viewDir  = new Vector3d(cp * cy, cp * sy, sp); 
                var right = new Vector3d(-sy, cy, 0);
                var moveDir = new Vector3d(cy, sy, 0); //flatened XY

                Vector3d move = moveDir * (forward * speedPerSec * dt)
                            + right  * (strafe  * speedPerSec * dt)
                            + zAxis* (vertical * speedPerSec * dt);

                camPlane = new Plane(camPlane.Origin + move, viewDir, right);
            }

            // --- Push to UI thread ---
        if (hasMoved && sinceLastUi >= uiDt && !_uiUpdatePending)
            {
                _uiUpdatePending = true;
                RhinoApp.InvokeOnUiThread((Action)(() =>
                {
                    try
                    {
                        var view = doc.Views.ActiveView;
                        var vp   = view.ActiveViewport;

                        vp.SetCameraLocation(camPlane.Origin, true);
                        vp.SetCameraDirection(camPlane.XAxis, true);       

                        view.Redraw();
                    }
                    finally
                    {
                        _uiUpdatePending  = false;
                    }
                }));
            }

            await Task.Delay(1, token);
        }
    }


    double GetPitch(double pitchAcc)=> Math.Max(-rad85, Math.Min(rad85, pitchAcc));  // Limit

    double GetNonLinearTrigger(double raw)=>  Math.Pow(raw, 2); // quadratic curve 


    protected (double x, double y) NormalizeStick(double nx, double ny)
    {
        double r2 = nx * nx + ny * ny;
        double dz = _deadzone;
        double dz2 = dz * dz;

        if (r2 <= dz2) 
            return (0, 0);

        double r = Math.Sqrt(r2);
        double invR = 1.0 / r;

        // direction
        double dirX = nx * invR;
        double dirY = ny * invR;

        // scale from deadzone to 1
        double scale = (r - dz) * (1.0 / Math.Max(1e-6, 1.0 - dz));

        double yaw   = -dirX * scale * _yawSensitivity;
        double pitch =  dirY * scale * _pitchSensitivity;
        return (yaw, pitch);
    }
}
# ---------- end world_up_turntable_first_person_no_roll_3 ----------
panel_7 = Panel(world_up_turntable_first_person_no_roll_3.a)

c_async = CSharpScript(
    run=Toggle(False),
    yawSensitivity=number_slider,
    pitchSensitivity=number_slider,
    deadzone=Slider(0.4452, range=0.0001..1),
    moveSpeed=Slider(146, range=0..300))  # -> out, a; inputs run: Boolean, yawSensitivity: Double, pitchSensitivity: Double, deadzone: Double, moveSpeed: Double; disabled
# ---------- c_async: C# ----------
#r "nuget: SharpDX, 4.2.0"
#r "nuget: SharpDX.XInput, 4.2.0"

using System;
using System.Collections.Generic;
using System.Threading;
using System.Threading.Tasks;
using SharpDX.XInput;

using Rhino;
using Rhino.Geometry;
using Rhino.Display;

public class Script_Instance : GH_ScriptInstance
{    
    private static CancellationTokenSource _cts;
    private static Status _status = Status.NotInitialized; 
    private List<int> _log;
    double _yawSensitivity,_pitchSensitivity,_deadzone,_moveSpeed;

    //Buttons
    private DateTime _lastPressedTime;
    private string _displayMessage = "";

    public enum Status
    {
        NotInitialized =0,
        Started =1,
        Stopped =2
    }

    #region COMPONENT

    private void RunScript(
		bool run,
		double yawSensitivity,
		double pitchSensitivity,
		double deadzone,
		double moveSpeed,
		ref object a)
        {
        _yawSensitivity =yawSensitivity; 
        _pitchSensitivity =pitchSensitivity;
        _deadzone = deadzone;
        _moveSpeed =moveSpeed;

        if(_status == Status.NotInitialized && run)
        {
            Initialize();
            Start();
        } else if (_status == Status.Stopped && run)
            Start();
        else if (_status == Status.Started && !run)
            Stop();

        a= _log;
    }

    void Initialize()
    {
        _log = new List<int>();
    }

    void Start()
    {
        _cts = new CancellationTokenSource();
        _ = Task.Run(() => Loop(_cts.Token), _cts.Token);
        _status = Status.Started;
    }

    void Stop()
    {
        _cts.Cancel();
        _status = Status.Stopped;
    }

    #endregion




    volatile bool _uiUpdatePending = false;
    static Plane camDir = Plane.WorldXY;
    private readonly object _camLock = new();

    async Task  Loop( CancellationToken token)
    {
        Controller controller = new Controller(UserIndex.One);
        RhinoDoc doc =RhinoDoc.ActiveDoc; 
        
        while (!token.IsCancellationRequested)
        {  
            if (!controller.IsConnected)
            {
                await Task.Delay(1000, token);
                continue;
            }

            var state = controller.GetState().Gamepad;

             // Inputs
            double speedMulti = _moveSpeed;   // planar speed multiplier
            double rotSpeedMulti = _moveSpeed;         // rotation speed multiplier
            double vertical = GetNonLinearTrigger(state.RightTrigger / 255.0)
                            - GetNonLinearTrigger(state.LeftTrigger / 255.0);

            var (yaw, pitch) = NormalizeStick(state.RightThumbX/ 32767.0, state.RightThumbY/ 32767.0);
            var (strafe, forward) = NormalizeStick(state.LeftThumbX/ 32767.0, state.LeftThumbY/ 32767.0);

  
            bool isVert = Math.Abs(vertical) > 0.02;

            RhinoApp.WriteLine("yaw: " + yaw + ", pitch: "+ pitch+  ", forward: "+ forward + ", strafe: " +strafe+ ", isVert" + isVert);

            bool hasMoved = yaw != 0 || pitch != 0 || forward != 0 || strafe != 0 || isVert;

            //RhinoApp.WriteLine("Moved: " + hasMoved);

            if (hasMoved)
            {
                // 1) compose a single transform in the camera's local frame
                var tYaw = Transform.Rotation(yaw * rotSpeedMulti, camDir.ZAxis, camDir.Origin);
                var tPitch = Transform.Rotation(pitch * rotSpeedMulti, -camDir.YAxis, camDir.Origin);
                var t = tPitch * tYaw; // order matters: yaw first, then pitch in the new frame

                camDir.Transform(t);

                // 2) Gram–Schmidt (keep a tight, right-handed, unit basis)
                var x = camDir.XAxis; x.Unitize();
                var z = camDir.ZAxis; z.Unitize();
                var y = Vector3d.CrossProduct(z, x); y.Unitize();
                z = Vector3d.CrossProduct(x, y); z.Unitize();
                camDir = new Plane(camDir.Origin, x, y);

                // 3) translate in the camera frame
                Vector3d move = camDir.XAxis * forward * speedMulti
                              + camDir.YAxis * strafe * speedMulti
                              + camDir.ZAxis * vertical;
                camDir.Translate(move);
            }
    
                if (hasMoved && !_uiUpdatePending)
                {
                    _uiUpdatePending = true;

                // Update the camera on the UI thread.
                Rhino.RhinoApp.InvokeOnUiThread((Action)(() =>
                {
                    Plane snap;
                    lock (_camLock) snap = camDir;  // snapshot

                    var view = doc.Views.ActiveView;
                    var vp = view.ActiveViewport;


                    if (hasMoved)
                    {
               
                            vp.SetCameraLocation(camDir.Origin, true);
                            vp.SetCameraDirection(camDir.XAxis, true);
             
                        view.Redraw();
                    }

                    _uiUpdatePending = false;
                }));
            }
            await Task.Delay(10, token);
        }
    }



    double GetNonLinearTrigger(double raw)=>  Math.Pow(raw, 2); // quadratic curve 


    protected (double x, double y) NormalizeStick(double normX, double normY)
    {
        double magnitude = Math.Sqrt(normX * normX + normY * normY);
        if (magnitude < _deadzone)
            return (0, 0);

        double scaled = Math.Clamp((magnitude - _deadzone) / (1 - _deadzone), 0, 1);

        // Normalize direction
        double dirX = normX / magnitude;
        double dirY = normY / magnitude;

        // Apply sensitivity and scale
        double yaw = -dirX * scaled * _yawSensitivity;
        double pitch = dirY * scaled * _pitchSensitivity;

        return (yaw, pitch);
    }
}
# ---------- end c_async ----------
c_task_yaw_pitch = CSharpScript(
    run=Toggle(False),
    yawSensitivity=number_slider_2,
    pitchSensitivity=number_slider_2,
    deadzone=Slider(0.1397, range=0.0001..1),
    moveSpeed=Slider(108, range=0..300))  # -> out, a; inputs run: Boolean, yawSensitivity: Double, pitchSensitivity: Double, deadzone: Double, moveSpeed: Double; disabled
# ---------- c_task_yaw_pitch: C# ----------
using System;
using System.Collections.Generic;
using System.Threading;
using System.Threading.Tasks;
using SharpDX.XInput;

using Rhino;
using Rhino.Geometry;
using Rhino.Display;

using Grasshopper;
using Grasshopper.Kernel;
using Grasshopper.Kernel.Data;
using Grasshopper.Kernel.Types;

#r "nuget: SharpDX, 4.2.0"
#r "nuget: SharpDX.XInput, 4.2.0"

public class Script_Instance : GH_ScriptInstance
{    
    private static CancellationTokenSource _cts;
    private static Status _status = Status.NotInitialized; 
    private List<int> _log;
    double _yawSensitivity,_pitchSensitivity,_deadzone,_moveSpeed;

    public enum Status
    {
        NotInitialized =0,
        Started =1,
        Stopped =2
    }

    private void RunScript(
		bool run,
		double yawSensitivity,
		double pitchSensitivity,
		double deadzone,
		double moveSpeed,
		ref object a)
    {

        _yawSensitivity =yawSensitivity; 
        _pitchSensitivity =pitchSensitivity;
        _deadzone = deadzone;
        _moveSpeed =moveSpeed;

        if(_status == Status.NotInitialized && run)
        {
            Initialize();
            Start();
        } else if (_status == Status.Stopped && run)
            Start();
        else if (_status == Status.Started && !run)
            Stop();

        a= _log;
    }

    (double x, double y) NormalizeStickInput(short rx, short ry)
    {
        double normX = rx / 32767.0;
        double normY = ry / 32767.0;

        normX = Math.Clamp(normX,-1,1);
        normY = Math.Clamp(normY,-1,1);

        double magnitude = Math.Sqrt(normX * normX + normY * normY);

        double deadzoneFixed = (magnitude - _deadzone) / (1 - _deadzone);
        deadzoneFixed = Math.Clamp(deadzoneFixed, 0, 1);

        // Final scaled input
        double finalX = normX / magnitude * deadzoneFixed;
        double finalY = normY / magnitude * deadzoneFixed;

        double yawAngle = -finalX * _yawSensitivity;
        double pitchAngle = finalY * _pitchSensitivity;  

        if  (magnitude < _deadzone)
            return (0, 0);

        return (yawAngle, pitchAngle);
    }

    void MoveCameraFlyMode(RhinoViewport vp, double forwardInput, double strafeInput)
    {
        Vector3d camDir = vp.CameraDirection;
        if (camDir.Length < Rhino.RhinoMath.ZeroTolerance)
            camDir = new Vector3d(0, 1, 0);
        camDir.Unitize();

        Vector3d right = Vector3d.CrossProduct(camDir, vp.CameraUp);
        if (right.Length < Rhino.RhinoMath.ZeroTolerance)
            right = new Vector3d(1, 0, 0);
        right.Unitize();

        Vector3d move = camDir * forwardInput * _moveSpeed + right * strafeInput * _moveSpeed;

        vp.SetCameraLocation(vp.CameraLocation + move,true);
    }

    void RotateCameraFlyMode(RhinoViewport vp, double yawInput, double pitchInput)
    {
        // Get the current camera direction
        Vector3d camDir = vp.CameraDirection;
        if (camDir.Length < Rhino.RhinoMath.ZeroTolerance)
            camDir = new Vector3d(0, 1, 0);
        camDir.Unitize();

        // Yaw (rotate around world Z)
        Transform yawTransform = Transform.Rotation(yawInput , Vector3d.ZAxis, Point3d.Origin);
        camDir.Transform(yawTransform);

        // Pitch (rotate around camera's right vector)
        Vector3d right = Vector3d.CrossProduct(camDir, Vector3d.ZAxis);
        if (right.Length < Rhino.RhinoMath.ZeroTolerance)
            right = new Vector3d(1, 0, 0);
        right.Unitize();

        Transform pitchTransform = Transform.Rotation(pitchInput, right, Point3d.Origin);
        camDir.Transform(pitchTransform);

        vp.SetCameraDirection(camDir, true);
    }

    void Initialize()
    {
        _log = new List<int>();
    }

    async Task  Loop( CancellationToken token)
    {
        Controller controller = new Controller(UserIndex.One);
        
        while (!token.IsCancellationRequested)
        {  
            if (controller.IsConnected)
            {
                var state = controller.GetState();

                Gamepad pad = state.Gamepad;

                (double yawInput,double pitchInput)= NormalizeStickInput(pad.RightThumbX, pad.RightThumbY);
                (double strafeInput,double forwardInput)= NormalizeStickInput(pad.LeftThumbX, pad.LeftThumbY);

                // Update the camera on the UI thread.
                Rhino.RhinoApp.InvokeOnUiThread((Action)(() =>
                {
                    var view = RhinoDoc.ActiveDoc.Views.ActiveView;
                    var vp = view.ActiveViewport;

                    bool redraw = false;
                        if (view != null && (yawInput!=0|| pitchInput!=0))
                        {
                            RotateCameraFlyMode(vp,  yawInput,  pitchInput);
                            redraw =true;
                        }

                        if (view != null && (strafeInput!=0|| forwardInput!=0))
                        {
                            MoveCameraFlyMode(vp, forwardInput, -strafeInput);
                            redraw =true;
                        }

                        if  (redraw)
                            view.Redraw();
                }));
            }

            await Task.Delay(10, token);
        }
    }

    void Stop()
    {
        _cts.Cancel();
        _status = Status.Stopped;
    }

    void Start()
    {
        _cts = new CancellationTokenSource();
        _ = Task.Run(() => Loop(_cts.Token), _cts.Token);
        _status = Status.Started;
    }

    void ExpireSolution()
    {
        // Credit: David Rutten, Eric Anastas
        // https://www.grasshopper3d.com/forum/topics/triggering-solution-refresh?overrideMobileRedirect=1&id=2985220%3ATopic%3A170034&page=1
        var expireAction = new Action<bool>(this.Component.ExpireSolution);

        Grasshopper.Instances.ActiveCanvas.Invoke(expireAction, new object[] { true });
        //The Action has to be invoked, because this method is called by the worker thread and not the mainthread
    }  
}
# ---------- end c_task_yaw_pitch ----------
c_change_speed = CSharpScript(
    run=Toggle(False),
    yawSensitivity=number_slider_3,
    pitchSensitivity=number_slider_3,
    deadzone=Slider(0.1689, range=0.0001..1),
    moveSpeed=Slider(146, range=0..300))  # -> out, a; inputs run: Boolean, yawSensitivity: Double, pitchSensitivity: Double, deadzone: Double, moveSpeed: Double; disabled
# ---------- c_change_speed: C# ----------
#r "nuget: SharpDX, 4.2.0"
#r "nuget: SharpDX.XInput, 4.2.0"

using System;
using System.Collections.Generic;
using System.Threading;
using System.Threading.Tasks;
using SharpDX.XInput;

using Rhino;
using Rhino.Geometry;
using Rhino.Display;

public class Script_Instance : GH_ScriptInstance
{    
    private static CancellationTokenSource _cts;
    private static Status _status = Status.NotInitialized; 
    private List<int> _log;
    double _yawSensitivity,_pitchSensitivity,_deadzone,_moveSpeed;

    //Buttons
    private DateTime _lastPressedTime;
    private string _displayMessage = "";

    public enum Status
    {
        NotInitialized =0,
        Started =1,
        Stopped =2
    }

    #region COMPONENT

    private void RunScript(
		bool run,
		double yawSensitivity,
		double pitchSensitivity,
		double deadzone,
		double moveSpeed,
		ref object a)
        {
        _yawSensitivity =yawSensitivity; 
        _pitchSensitivity =pitchSensitivity;
        _deadzone = deadzone;
        _moveSpeed =moveSpeed;

        if(_status == Status.NotInitialized && run)
        {
            Initialize();
            Start();
        } else if (_status == Status.Stopped && run)
            Start();
        else if (_status == Status.Started && !run)
            Stop();

        a= _log;
    }

    void Initialize()
    {
        _log = new List<int>();

        RhinoApp.Closing += (sender, e) =>{SaveSettings();};

        LoadSettings();
    }

    void Start()
    {
        _cts = new CancellationTokenSource();
        _ = Task.Run(() => Loop(_cts.Token), _cts.Token);
        _status = Status.Started;

        Rhino.Display.DisplayPipeline.DrawForeground += DrawText;    
    }

    void Stop()
    {
        _cts.Cancel();
        _status = Status.Stopped;

        Rhino.Display.DisplayPipeline.DrawForeground -= DrawText;  
    }

    void ExpireSolution()
    {
       var expireAction = new Action<bool>(this.Component.ExpireSolution);
        Grasshopper.Instances.ActiveCanvas.Invoke(expireAction, new object[] { true });
    } 

    #endregion

    #region DISPLAY
    void DrawText(object sender, Rhino.Display.DrawEventArgs e)
    {
        var activeView = Rhino.RhinoDoc.ActiveDoc.Views.ActiveView;
        if (e.Viewport.Id != activeView.MainViewport.Id)
            return;

        var screenPoint = new Point2d(50, 50);
        e.Display.Draw2dText(_displayMessage, System.Drawing.Color.Black, screenPoint, false, 25);
    }
    #endregion 

    #region LOOP
    async Task  Loop( CancellationToken token)
    {
        Controller controller = new Controller(UserIndex.One);
        RhinoDoc doc =RhinoDoc.ActiveDoc; 
        
        while (!token.IsCancellationRequested)
        {  
            if (!controller.IsConnected)
            {
                await Task.Delay(1000, token);
                continue;
            }

            var pad = controller.GetState().Gamepad;

            bool l3 = (pad.Buttons & GamepadButtonFlags.LeftThumb) != 0;
            bool r3 = (pad.Buttons & GamepadButtonFlags.RightThumb) != 0;

            //LastPressed
            if (l3 || r3)
            {
                _displayMessage = "BOOSTER";
                _lastPressedTime = DateTime.Now;
            }

            // Apply speed multiplier if active
            double speed = l3 ? 3 * _moveSpeed : _moveSpeed;
            double rotSpeed = r3? 3 : 1;

             // Triggers for vertical movement
            double vertical =   GetNonLinearTrigger(pad.RightTrigger / 255.0) -
                                GetNonLinearTrigger(pad.LeftTrigger / 255.0);

            // Calculate input
            (double yaw,double pitch)= NormalizeStickInput(pad.RightThumbX, pad.RightThumbY);
            (double strafe,double forward)= NormalizeStickInput(pad.LeftThumbX, pad.LeftThumbY);

            // Update the camera on the UI thread.
            Rhino.RhinoApp.InvokeOnUiThread((Action)(() =>
            {
                var view = doc.Views.ActiveView;
                var vp = view.ActiveViewport;

                bool redraw = false;

                if (yaw != 0 || pitch != 0 || forward != 0 || strafe != 0 || Math.Abs(vertical) > 0.02)
                {
                    ApplyCameraFlyControls(vp, forward, -strafe, vertical, yaw, pitch, speed, rotSpeed);
                    redraw = true;
                }

                if ((DateTime.Now - _lastPressedTime).TotalSeconds >= 0.5)
                    _displayMessage = "";

                if  (redraw)
                    view.Redraw();
            }));

            await Task.Delay(10, token);
        }
    }
    #endregion

    #region GAMEPAD 
    double GetNonLinearTrigger(double raw)=>  Math.Pow(raw, 2); // quadratic curve 

    void ApplyCameraFlyControls(RhinoViewport vp, double forward, double strafe, double vertical, double yaw, double pitch, double speed, double rotSpeed)
    {
        Vector3d camDir = vp.CameraDirection;

        // Rotation: Yaw around world Z
        camDir.Transform(Transform.Rotation(yaw * rotSpeed, Vector3d.ZAxis, Point3d.Origin));

        // Rotation: Pitch around right vector
        Vector3d right = Vector3d.CrossProduct(camDir, Vector3d.ZAxis);

        camDir.Transform(Transform.Rotation(pitch * rotSpeed, right, Point3d.Origin));
        vp.SetCameraDirection(camDir, true);

        // Recalculate right vector after rotation
        right = Vector3d.CrossProduct(camDir, vp.CameraUp);

        // Movement
        Vector3d move = Vector3d.ZAxis * vertical +
                        camDir * forward * speed +
                        right * strafe * speed;

        vp.SetCameraLocation(vp.CameraLocation + move, true);
    }

    (double x, double y) NormalizeStickInput(short rx, short ry)
    {
        double normX = rx / 32767.0;
        double normY = ry / 32767.0;

        double magnitude = Math.Sqrt(normX * normX + normY * normY);
        if (magnitude < _deadzone)
            return (0, 0);

        double scaled = Math.Clamp((magnitude - _deadzone) / (1 - _deadzone), 0, 1);

        // Normalize direction
        double dirX = normX / magnitude;
        double dirY = normY / magnitude;

        // Apply sensitivity and scale
        double yaw = -dirX * scaled * _yawSensitivity;
        double pitch = dirY * scaled * _pitchSensitivity;

        return (yaw, pitch);
    }
    #endregion

    #region LOAD/SAVE

    void SaveSettings()
    {
        var lines = new List<string>
        {
            _yawSensitivity.ToString(),
            _pitchSensitivity.ToString(),
            _deadzone.ToString(),
            _moveSpeed.ToString()
        };
        System.IO.File.WriteAllLines(settingsPath, lines);
    }

    void LoadSettings()
    {
        if (!System.IO.File.Exists(settingsPath)) return;
        var lines = System.IO.File.ReadAllLines(settingsPath);
        if (lines.Length >= 4)
        {
            _yawSensitivity = double.Parse(lines[0]);
            _pitchSensitivity = double.Parse(lines[1]);
            _deadzone = double.Parse(lines[2]);
            _moveSpeed = double.Parse(lines[3]);
        }
    }

    string settingsPath = System.IO.Path.Combine(Environment.GetFolderPath(Environment.SpecialFolder.ApplicationData), "MyRhinoControllerSettings.txt");

    #endregion
}
# ---------- end c_change_speed ----------
world_up_turntable_first_person_no_roll_4 = CSharpScript(
    run=Toggle(False),
    yawSensitivity=number_slider_4,
    pitchSensitivity=number_slider_4,
    deadzone=Slider(0.1851, range=0.0001..1),
    moveSpeed=Slider(10000, range=0..10000),
    rotSpeed=Slider(280, range=0..1000))  # -> out, a; inputs run: Boolean, yawSensitivity: Double, pitchSensitivity: Double, deadzone: Double, moveSpeed: Double, rotSpeed: Double; disabled
# ---------- world_up_turntable_first_person_no_roll_4: C# ----------
#r "nuget: SharpDX, 4.2.0"
#r "nuget: SharpDX.XInput, 4.2.0"

using System;
using System.Collections.Generic;
using System.Threading;
using System.Threading.Tasks;
using SharpDX.XInput;

using Rhino;
using Rhino.Geometry;
using Rhino.Display;

public class Script_Instance : GH_ScriptInstance
{    
    private static CancellationTokenSource _cts;
    private static Status _status = Status.NotInitialized; 
    private List<int> _log;
    double _yawSensitivity,_pitchSensitivity,_deadzone,_moveSpeed, _rotSpeed;

    //Buttons
    private DateTime _lastPressedTime;
    private string _displayMessage = "";

    public enum Status
    {
        NotInitialized =0,
        Started =1,
        Stopped =2
    }

    #region COMPONENT

    private void RunScript(
		bool run,
		double yawSensitivity,
		double pitchSensitivity,
		double deadzone,
		double moveSpeed,
		double rotSpeed,
		ref object a)
        {
        _yawSensitivity =yawSensitivity; 
        _pitchSensitivity =pitchSensitivity;
        _deadzone = deadzone;
        _moveSpeed =moveSpeed;
        _rotSpeed =rotSpeed;

        if(_status == Status.NotInitialized && run)
        {
            Initialize();
            Start();
        } else if (_status == Status.Stopped && run)
            Start();
        else if (_status == Status.Started && !run)
            Stop();

        a= _log;
    }

    void Initialize()
    {
        _log = new List<int>();
    }

    void Start()
    {
        _cts = new CancellationTokenSource();
        _ = Task.Run(() => Loop(_cts.Token), _cts.Token);
        _status = Status.Started;
    }

    void Stop()
    {
        _cts.Cancel();
        _status = Status.Stopped;
    }

    #endregion


    // fields
    volatile bool _uiUpdatePending = false;
    volatile bool _isApplyingCamera = false;
    static Plane camPlane;
    readonly object _camLock = new();

        // fields
    double yawAcc = 0.0, pitchAcc = 0.0;
     Vector3d zAxis = Vector3d.ZAxis;
     double rad85 = RhinoMath.ToRadians(89);

   async Task Loop(CancellationToken token)
{
    Controller controller = new Controller(UserIndex.One);
    RhinoDoc doc = RhinoDoc.ActiveDoc;

    while (!token.IsCancellationRequested)
    {
        if (!controller.IsConnected)
        {
            await Task.Delay(1000, token);
            continue;
        }

        var state = controller.GetState().Gamepad;

        // Inputs
        double speedMulti    = _moveSpeed;   // units per tick
        double rotSpeedMulti = _rotSpeed;    // radians per tick
        double vertical = GetNonLinearTrigger(state.RightTrigger / 255.0)
                        - GetNonLinearTrigger(state.LeftTrigger  / 255.0);

        var (yaw,   pitch)  = NormalizeStick(state.RightThumbX / 32767.0, state.RightThumbY / 32767.0);
        var (strafe,forward)= NormalizeStick(state.LeftThumbX  / 32767.0, state.LeftThumbY  / 32767.0);

        bool isVert  = Math.Abs(vertical) > 0.02;
        bool hasMoved = yaw != 0 || pitch != 0 || forward != 0 || strafe != 0 || isVert;

        // --- Idle re-sync: if user moved the viewport with mouse, adopt it AND rebase angles ---
        if (!hasMoved && !_uiUpdatePending && !_isApplyingCamera)
        {
            var vp = doc.Views.ActiveView.ActiveViewport;

            // Read current viewport camera
            Vector3d camDir = vp.CameraDirection; 

            // Turntable basis (use world up to remove roll)
            Vector3d right = Vector3d.CrossProduct(zAxis, camDir);
            
            if (!right.Unitize()) 
                right = Vector3d.XAxis; // guard near poles

            // Update camPlane from viewport
            camPlane = new Plane(vp.CameraLocation, camDir, right);

            // Rebase angle accumulators to match viewport direction
            double newYaw   = Math.Atan2(camDir.Y, camDir.X);
            double newPitch = Math.Asin(camDir.Z);
            
            pitchAcc = GetPitch( newPitch); //Limit
            yawAcc   = newYaw;
        }

        // --- Per frame movement when there is input ---
        if (hasMoved)
        {
            yawAcc   += yaw   * rotSpeedMulti;
            pitchAcc += pitch * rotSpeedMulti;
            pitchAcc  =  GetPitch( pitchAcc);

            // Rebuild basis from yaw/pitch (turntable, world-up = +Z)
            double cy = Math.Cos(yawAcc);
            double sy = Math.Sin(yawAcc);
            double cp = Math.Cos(pitchAcc);
            double sp = Math.Sin(pitchAcc);

            var fwd = new Vector3d(cp * cy, cp * sy, sp); 
            fwd.Unitize();
                      // X
            var right = Vector3d.CrossProduct(zAxis, fwd); 
            right.Unitize();      // Y

            // Apply translation in this frame (per tick)
            Vector3d move = fwd    * (forward * speedMulti)
                          + right  * (strafe  * speedMulti)
                          + zAxis* (vertical * speedMulti);

                var origin = camPlane.Origin + move;
                camPlane = new Plane(origin, fwd, right); // X=fwd, Y=right, Z=up
        }

        // --- Push to UI thread ---
        if (hasMoved && !_uiUpdatePending)
        {
            _uiUpdatePending = true;
            RhinoApp.InvokeOnUiThread((Action)(() =>
            {
                _isApplyingCamera = true;
                try
                {
                    var view = doc.Views.ActiveView;
                    var vp   = view.ActiveViewport;

                    vp.SetCameraLocation(camPlane.Origin, true);
                    vp.SetCameraDirection(camPlane.XAxis, true);       

                    view.Redraw();
                }
                finally
                {
                    _isApplyingCamera = false;
                    _uiUpdatePending  = false;
                }
            }));
        }

        await Task.Delay(10, token);
    }
}

// Limit
double GetPitch(double pitchAcc)=> Math.Max(-rad85, Math.Min(rad85, pitchAcc));

    double GetNonLinearTrigger(double raw)=>  Math.Pow(raw, 2); // quadratic curve 

    protected (double x, double y) NormalizeStick(double normX, double normY)
    {
        double magnitude = Math.Sqrt(normX * normX + normY * normY);
        if (magnitude < _deadzone)
            return (0, 0);

        double scaled = Math.Clamp((magnitude - _deadzone) / (1 - _deadzone), 0, 1);

        // Normalize direction
        double dirX = normX / magnitude;
        double dirY = normY / magnitude;

        // Apply sensitivity and scale
        double yaw = -dirX * scaled * _yawSensitivity;
        double pitch = dirY * scaled * _pitchSensitivity;

        return (yaw, pitch);
    }
}
# ---------- end world_up_turntable_first_person_no_roll_4 ----------
panel_8 = Panel(c_async.a)
panel_9 = Panel(c_task_yaw_pitch.a)
panel_10 = Panel(c_change_speed.a)
panel_11 = Panel(world_up_turntable_first_person_no_roll_4.a)
number_slider_10 = Slider(0.037, range=0..0.5)
c_script = CSharpScript(y=Button())  # -> out, a; disabled
# ---------- c_script: C# ----------
// Grasshopper Script Instance
#r "nuget: SharpDX, 4.2.0"
#r "nuget: SharpDX.XInput, 4.2.0"

#region Usings
using System;
using System.Linq;
using System.Collections;
using System.Collections.Generic;
using System.Drawing;

using Rhino;
using Rhino.Geometry;

using Grasshopper;
using Grasshopper.Kernel;
using Grasshopper.Kernel.Data;
using Grasshopper.Kernel.Types;
using SharpDX.XInput;
using System.Timers;
#endregion

public class Script_Instance : GH_ScriptInstance
{
    #region Notes
    /* 
      Members:
        RhinoDoc RhinoDocument
        GH_Document GrasshopperDocument
        IGH_Component Component
        int Iteration

      Methods (Virtual & overridable):
        Print(string text)
        Print(string format, params object[] args)
        Reflect(object obj)
        Reflect(object obj, string method_name)
    */
    #endregion


    private static Controller controller;
    private static Timer timer;
    private static string lastButtonPress = "No input";
    
    // Initialize Controller
    static Script_Instance()
    {
        controller = new Controller(UserIndex.One);
        
        if (!controller.IsConnected)
        {
            lastButtonPress = "Controller not connected.";
        }
        else
        {
            // Create a Timer to check the button states every 100ms
            timer = new Timer(100);
            timer.Elapsed += CheckControllerState;
            timer.Start();
        }
    }

     private static void CheckControllerState(object sender, ElapsedEventArgs e)
    {
        if (!controller.IsConnected)
        {
            lastButtonPress = "Controller disconnected.";
            return;
        }

        State state = controller.GetState();
        var gamepad = state.Gamepad;
        List<string> pressedButtons = new List<string>();

        if ((gamepad.Buttons & GamepadButtonFlags.A) != 0) pressedButtons.Add("A");
        if ((gamepad.Buttons & GamepadButtonFlags.B) != 0) pressedButtons.Add("B");
        if ((gamepad.Buttons & GamepadButtonFlags.X) != 0) pressedButtons.Add("X");
        if ((gamepad.Buttons & GamepadButtonFlags.Y) != 0) pressedButtons.Add("Y");
        if ((gamepad.Buttons & GamepadButtonFlags.Start) != 0) pressedButtons.Add("Start");
        if ((gamepad.Buttons & GamepadButtonFlags.Back) != 0) pressedButtons.Add("Back");
        if ((gamepad.Buttons & GamepadButtonFlags.LeftShoulder) != 0) pressedButtons.Add("Left Shoulder");
        if ((gamepad.Buttons & GamepadButtonFlags.RightShoulder) != 0) pressedButtons.Add("Right Shoulder");
        if ((gamepad.Buttons & GamepadButtonFlags.LeftThumb) != 0) pressedButtons.Add("Left Thumb");
        if ((gamepad.Buttons & GamepadButtonFlags.RightThumb) != 0) pressedButtons.Add("Right Thumb");
        if ((gamepad.Buttons & GamepadButtonFlags.DPadUp) != 0) pressedButtons.Add("DPad Up");
        if ((gamepad.Buttons & GamepadButtonFlags.DPadDown) != 0) pressedButtons.Add("DPad Down");
        if ((gamepad.Buttons & GamepadButtonFlags.DPadLeft) != 0) pressedButtons.Add("DPad Left");
        if ((gamepad.Buttons & GamepadButtonFlags.DPadRight) != 0) pressedButtons.Add("DPad Right");

          lastButtonPress = pressedButtons.Count > 0 ? string.Join(", ", pressedButtons) : "No buttons pressed.";
    }



    private void RunScript(object x, object y, ref object a)
    {
        // Write your logic here
             a= lastButtonPress;
    }
}
# ---------- end c_script ----------
c_script_2 = CSharpScript(STATUS=Toggle(False))  # -> out, A; inputs STATUS: Boolean; disabled
# ---------- c_script_2: C# ----------
using System;
using System.Linq;
using System.Collections;
using System.Collections.Generic;
using System.Drawing;

using Rhino;
using Rhino.Geometry;

using Grasshopper;
using Grasshopper.Kernel;
using Grasshopper.Kernel.Data;
using Grasshopper.Kernel.Types;

using System.Threading;
using SharpDX.XInput;

#r "nuget: SharpDX, 4.2.0"
#r "nuget: SharpDX.XInput, 4.2.0"

public class Script_Instance : GH_ScriptInstance
{

// These two fields remain persistent between component updates.
private bool continueLoop = false;

private void RunScript(bool STATUS, ref object A)
{
    Controller controller = new Controller(UserIndex.One);
    // Start the background task if STATUS is true and the task isn't already running.
    if (STATUS && !continueLoop)
    {
        continueLoop = true;

        System.Threading.Tasks.Task.Run(() =>
        {
            // Sensitivity factors for rotation (adjust as needed)
            double yawSensitivity = 0.0005;   // Horizontal rotation sensitivity
            double pitchSensitivity = 0.0005; // Vertical rotation sensitivity

            // Deadzone threshold to prevent unintentional rotations when the stick is near center.
            short deadzone = 8000;
    

            while (continueLoop)
            {
                // if (!controller.IsConnected)
                // continue;

                var state = controller.GetState();
                short rightX = state.Gamepad.RightThumbX;
                short rightY = state.Gamepad.RightThumbY;

                // Only process input if the right stick is moved outside the deadzone.
                if (Math.Abs(rightX) > deadzone || Math.Abs(rightY) > deadzone)
                {
                    // Normalize stick values to the range [-1,1]
                    double normalizedX = rightX / 32767.0;
                    double normalizedY = rightY / 32767.0;

                    // Compute rotation angles. For pitch, we typically invert the value so that pushing up looks up.
                    double rotationAngleYaw = normalizedX * yawSensitivity;
                    double rotationAnglePitch = -normalizedY * pitchSensitivity;

                    var view = RhinoDoc.ActiveDoc.Views.ActiveView;
                    var viewport = view.ActiveViewport;
                    
                    // Get current camera location and target.
                    Point3d camLoc = viewport.CameraLocation;
                    Point3d camTarget = viewport.CameraTarget;
                    Vector3d camDir = camTarget - camLoc;
                    double distance = camDir.Length;
                    //camDir.Unitize();

                    // Define the world up vector (assumed Z-up in Rhino).
                    Vector3d worldUp = new Vector3d(0, 0, 1);

                    // --- Horizontal (Yaw) Rotation ---
                    // Rotate the camera direction around the world up axis.
                    Transform yawTransform = Transform.Rotation(rotationAngleYaw, worldUp, camLoc);
                    camDir.Transform(yawTransform);

                    // --- Vertical (Pitch) Rotation ---
                    // Compute the camera's right vector from the updated direction.
                    Vector3d camRight = Vector3d.CrossProduct(camDir, worldUp);
                    camRight.Unitize();
                    // Rotate around the camera's right vector.
                    Transform pitchTransform = Transform.Rotation(rotationAnglePitch, camRight, camLoc);
                    camDir.Transform(pitchTransform);

                    // Calculate the new camera target using the rotated direction.
                    Point3d newCamTarget = camLoc + camDir * distance;
                    // Update the camera parameters.
                    viewport.SetCameraLocation(camLoc, false);
                    //viewport.SetCameraLocation(new Point3d(), true);
                    viewport.SetCameraTarget(newCamTarget, false);
                }

                // Sleep briefly to allow for smoother control and reduce CPU usage.
                Thread.Sleep(50);
            }
        });
    }
    else if (!STATUS) // If STATUS is false, signal the task to stop.
        continueLoop = false;
    }
}
# ---------- end c_script_2 ----------
panel_12 = Panel(c_script_2.A)
panel_13 = Panel(c_script.a)
c_yaw_pitch = CSharpScript(
    STATUS=Toggle(False),
    yawSensitivity=number_slider_10,
    pitchSensitivity=number_slider_10,
    deadzone=Slider(0.1664, range=0.0001..1))  # -> out, A; inputs STATUS: Boolean, yawSensitivity: Double, pitchSensitivity: Double, deadzone: Double; disabled
# ---------- c_yaw_pitch: C# ----------
using System;
using System.Linq;
using System.Collections;
using System.Collections.Generic;
using System.Drawing;

using Rhino;
using Rhino.Geometry;

using Grasshopper;
using Grasshopper.Kernel;
using Grasshopper.Kernel.Data;
using Grasshopper.Kernel.Types;

using System.Threading;
using SharpDX.XInput;

#r "nuget: SharpDX, 4.2.0"
#r "nuget: SharpDX.XInput, 4.2.0"

public class Script_Instance : GH_ScriptInstance
{

// These two fields remain persistent between component updates.
private bool continueLoop = false;

private void RunScript(
		bool STATUS,
		double yawSensitivity,
		double pitchSensitivity,
		double deadzone,
		ref object A)
{
    Controller controller = new Controller(UserIndex.One);
    // Start the background task if STATUS is true and the task isn't already running.
       if (STATUS && !continueLoop)
    {
        continueLoop = true;

        // Start the background task.
        System.Threading.Tasks.Task.Run(() =>
        {
            Controller controller = new Controller(UserIndex.One);
            while (continueLoop)
            {
                if (controller.IsConnected)
                {
                    var state = controller.GetState();


                    Gamepad pad = state.Gamepad;

                    short rx = pad.RightThumbX;
                    short ry = pad.RightThumbY;

                    double normX = rx / 32767.0;
                    double normY = ry / 32767.0;

                    normX = Math.Clamp(normX,-1,1);
                    normY = Math.Clamp(normY,-1,1);

 
                        double yawAngle = -normX * yawSensitivity;
                        double pitchAngle = normY * pitchSensitivity; // invert Y to mimic typical FPS controls


                    if (Math.Abs(normX) < deadzone || Math.Abs(normY) < deadzone)
                    {
                    
                    }else
                    {
                               // Update the camera on the UI thread.
                    Rhino.RhinoApp.InvokeOnUiThread((Action)(() =>
                    {
                     var view = RhinoDoc.ActiveDoc.Views.ActiveView;
                            if (view != null)
                            {
                                var vp = view.ActiveViewport;
                                
                                // Get the current camera direction as a normalized vector.
                                Vector3d camDir = vp.CameraDirection;
                                if (camDir.Length < Rhino.RhinoMath.ZeroTolerance)
                                    camDir = new Vector3d(0, 1, 0);
                                camDir.Unitize();
                                
                                // --- Yaw Rotation ---
                                // Rotate the camera direction around the world up (Z-axis).
                                Transform yawTransform = Transform.Rotation(yawAngle, Vector3d.ZAxis, Point3d.Origin);
                                camDir.Transform(yawTransform);
                                
                                // --- Pitch Rotation ---
                                // Compute the right vector from the updated direction.
                                Vector3d right = Vector3d.CrossProduct(camDir, Vector3d.ZAxis);
                                if (right.Length < Rhino.RhinoMath.ZeroTolerance)
                                    right = new Vector3d(1, 0, 0);
                                right.Unitize();
                                Transform pitchTransform = Transform.Rotation(pitchAngle, right, Point3d.Origin);
                                camDir.Transform(pitchTransform);
                                
                                // Set the updated camera direction.
                                vp.SetCameraDirection(camDir, true);
                                view.Redraw();
                            }
                    }));
                    }
         
            

                }
                Thread.Sleep(20); // Pause briefly to reduce CPU usage and control update speed.
            }
        });
    }
    else if (!STATUS) // If STATUS is false, signal the task to stop.
        continueLoop = false;
    }
}
# ---------- end c_yaw_pitch ----------
number_slider_11 = Slider(0.037, range=0..0.5)
number_slider_12 = Slider(0.037, range=0..0.5)
number_slider_13 = Slider(0.038, range=0..0.5)
panel_14 = Panel(c_yaw_pitch.A)
c_task_yaw_pitch_2 = CSharpScript(
    run=Toggle(False),
    yawSensitivity=number_slider_11,
    pitchSensitivity=number_slider_11,
    deadzone=Slider(0.1664, range=0.0001..1))  # -> out, a; inputs run: Boolean, yawSensitivity: Double, pitchSensitivity: Double, deadzone: Double; disabled
# ---------- c_task_yaw_pitch_2: C# ----------
using System;
using System.Collections.Generic;
using System.Threading;
using System.Threading.Tasks;
using SharpDX.XInput;

using Rhino;
using Rhino.Geometry;

using Grasshopper;
using Grasshopper.Kernel;
using Grasshopper.Kernel.Data;
using Grasshopper.Kernel.Types;

#r "nuget: SharpDX, 4.2.0"
#r "nuget: SharpDX.XInput, 4.2.0"

public class Script_Instance : GH_ScriptInstance
{    
    private static CancellationTokenSource _cts;
    private static Status _status = Status.NotInitialized; 
    private List<int> _log;

    public enum Status
    {
        NotInitialized =0,
        Started =1,
        Stopped =2
    }

double _yawSensitivity,_pitchSensitivity,_deadzone;

    private void RunScript(
		bool run,
		double yawSensitivity,
		double pitchSensitivity,
		double deadzone,
		ref object a)
    {

        _yawSensitivity =yawSensitivity; 
        _pitchSensitivity =pitchSensitivity;
        _deadzone = deadzone;



        if(_status == Status.NotInitialized && run)
        {
            Initialize();
            Start();
        } else if (_status == Status.Stopped && run)
            Start();
        else if (_status == Status.Started && !run)
            Stop();

        a= _log;
    }

    void Initialize()
    {
        _log = new List<int>();
    }

    async Task  Loop( CancellationToken token)
    {
        Controller controller = new Controller(UserIndex.One);
        
        while (!token.IsCancellationRequested)
        {  

            if (controller.IsConnected)
                {
                    var state = controller.GetState();

                    Gamepad pad = state.Gamepad;

                    short rx = pad.RightThumbX;
                    short ry = pad.RightThumbY;

                    double normX = rx / 32767.0;
                    double normY = ry / 32767.0;

                    normX = Math.Clamp(normX,-1,1);
                    normY = Math.Clamp(normY,-1,1);

 
                        double yawAngle = -normX * _yawSensitivity;
                        double pitchAngle = normY * _pitchSensitivity; // invert Y to mimic typical FPS controls


                    if (Math.Abs(normX) < _deadzone || Math.Abs(normY) < _deadzone)
                    {
                    
                    }else
                    {
                    //            // Update the camera on the UI thread.
                    Rhino.RhinoApp.InvokeOnUiThread((Action)(() =>
                    {
                     var view = RhinoDoc.ActiveDoc.Views.ActiveView;
                            if (view != null)
                            {
                                var vp = view.ActiveViewport;
                                
                                // Get the current camera direction as a normalized vector.
                                Vector3d camDir = vp.CameraDirection;
                                if (camDir.Length < Rhino.RhinoMath.ZeroTolerance)
                                    camDir = new Vector3d(0, 1, 0);
                                camDir.Unitize();
                                
                                // --- Yaw Rotation ---
                                // Rotate the camera direction around the world up (Z-axis).
                                Transform yawTransform = Transform.Rotation(yawAngle, Vector3d.ZAxis, Point3d.Origin);
                                camDir.Transform(yawTransform);
                                
                                // --- Pitch Rotation ---
                                // Compute the right vector from the updated direction.
                                Vector3d right = Vector3d.CrossProduct(camDir, Vector3d.ZAxis);
                                if (right.Length < Rhino.RhinoMath.ZeroTolerance)
                                    right = new Vector3d(1, 0, 0);
                                right.Unitize();
                                Transform pitchTransform = Transform.Rotation(pitchAngle, right, Point3d.Origin);
                                camDir.Transform(pitchTransform);
                                
                                // Set the updated camera direction.
                                vp.SetCameraDirection(camDir, true);
                                view.Redraw();
                            }
                    }));
                     }
         
            

                }

           
            
            await Task.Delay(20, token);

            ExpireSolution();
        }
    }

    void Stop()
    {
        _cts.Cancel();
        _status = Status.Stopped;
    }

    void Start()
    {
        _cts = new CancellationTokenSource();
        _ = Task.Run(() => Loop(_cts.Token), _cts.Token);
        _status = Status.Started;
    }

    void ExpireSolution()
    {
        // Credit: David Rutten, Eric Anastas
        // https://www.grasshopper3d.com/forum/topics/triggering-solution-refresh?overrideMobileRedirect=1&id=2985220%3ATopic%3A170034&page=1
        var expireAction = new Action<bool>(this.Component.ExpireSolution);

        Grasshopper.Instances.ActiveCanvas.Invoke(expireAction, new object[] { true });
        //The Action has to be invoked, because this method is called by the worker thread and not the mainthread
    }  
}
# ---------- end c_task_yaw_pitch_2 ----------
c_task_yaw_pitch_3 = CSharpScript(
    run=Toggle(False),
    yawSensitivity=number_slider_12,
    pitchSensitivity=number_slider_12,
    deadzone=Slider(0.1547, range=0.0001..1))  # -> out, a; inputs run: Boolean, yawSensitivity: Double, pitchSensitivity: Double, deadzone: Double; disabled
# ---------- c_task_yaw_pitch_3: C# ----------
using System;
using System.Collections.Generic;
using System.Threading;
using System.Threading.Tasks;
using SharpDX.XInput;

using Rhino;
using Rhino.Geometry;

using Grasshopper;
using Grasshopper.Kernel;
using Grasshopper.Kernel.Data;
using Grasshopper.Kernel.Types;

#r "nuget: SharpDX, 4.2.0"
#r "nuget: SharpDX.XInput, 4.2.0"

public class Script_Instance : GH_ScriptInstance
{    
    private static CancellationTokenSource _cts;
    private static Status _status = Status.NotInitialized; 
    private List<int> _log;

    public enum Status
    {
        NotInitialized =0,
        Started =1,
        Stopped =2
    }

double _yawSensitivity,_pitchSensitivity,_deadzone;

    private void RunScript(
		bool run,
		double yawSensitivity,
		double pitchSensitivity,
		double deadzone,
		ref object a)
    {

        _yawSensitivity =yawSensitivity; 
        _pitchSensitivity =pitchSensitivity;
        _deadzone = deadzone;



        if(_status == Status.NotInitialized && run)
        {
            Initialize();
            Start();
        } else if (_status == Status.Stopped && run)
            Start();
        else if (_status == Status.Started && !run)
            Stop();

        a= _log;
    }

    void Initialize()
    {
        _log = new List<int>();
    }

    async Task  Loop( CancellationToken token)
    {
        Controller controller = new Controller(UserIndex.One);
        
        while (!token.IsCancellationRequested)
        {  

            if (controller.IsConnected)
                {
                    var state = controller.GetState();

                    Gamepad pad = state.Gamepad;

                    short rx = pad.RightThumbX;
                    short ry = pad.RightThumbY;

                    double normX = rx / 32767.0;
                    double normY = ry / 32767.0;

                    normX = Math.Clamp(normX,-1,1);
                    normY = Math.Clamp(normY,-1,1);

 
                    double yawAngle = -normX * _yawSensitivity;
                    double pitchAngle = normY * _pitchSensitivity; // invert Y to mimic typical FPS controls

                    double magnitude = Math.Sqrt(normX * normX + normY * normY);

                    if (magnitude < _deadzone)
                    {
                    
                    }else
                    {
                    //            // Update the camera on the UI thread.
                    Rhino.RhinoApp.InvokeOnUiThread((Action)(() =>
                    {
                     var view = RhinoDoc.ActiveDoc.Views.ActiveView;
                            if (view != null)
                            {
                                var vp = view.ActiveViewport;
                                
                                // Get the current camera direction as a normalized vector.
                                Vector3d camDir = vp.CameraDirection;
                                if (camDir.Length < Rhino.RhinoMath.ZeroTolerance)
                                    camDir = new Vector3d(0, 1, 0);
                                camDir.Unitize();
                                
                                // --- Yaw Rotation ---
                                // Rotate the camera direction around the world up (Z-axis).
                                Transform yawTransform = Transform.Rotation(yawAngle, Vector3d.ZAxis, Point3d.Origin);
                                camDir.Transform(yawTransform);
                                
                                // --- Pitch Rotation ---
                                // Compute the right vector from the updated direction.
                                Vector3d right = Vector3d.CrossProduct(camDir, Vector3d.ZAxis);
                                if (right.Length < Rhino.RhinoMath.ZeroTolerance)
                                    right = new Vector3d(1, 0, 0);
                                right.Unitize();
                                Transform pitchTransform = Transform.Rotation(pitchAngle, right, Point3d.Origin);
                                camDir.Transform(pitchTransform);
                                
                                // Set the updated camera direction.
                                vp.SetCameraDirection(camDir, true);
                                view.Redraw();
                            }
                    }));
                     }
         
            

                }

           
            
            await Task.Delay(20, token);

            ExpireSolution();
        }
    }

    void Stop()
    {
        _cts.Cancel();
        _status = Status.Stopped;
    }

    void Start()
    {
        _cts = new CancellationTokenSource();
        _ = Task.Run(() => Loop(_cts.Token), _cts.Token);
        _status = Status.Started;
    }

    void ExpireSolution()
    {
        // Credit: David Rutten, Eric Anastas
        // https://www.grasshopper3d.com/forum/topics/triggering-solution-refresh?overrideMobileRedirect=1&id=2985220%3ATopic%3A170034&page=1
        var expireAction = new Action<bool>(this.Component.ExpireSolution);

        Grasshopper.Instances.ActiveCanvas.Invoke(expireAction, new object[] { true });
        //The Action has to be invoked, because this method is called by the worker thread and not the mainthread
    }  
}
# ---------- end c_task_yaw_pitch_3 ----------
c_task_yaw_pitch_4 = CSharpScript(
    run=Toggle(False),
    yawSensitivity=number_slider_13,
    pitchSensitivity=number_slider_13,
    deadzone=Slider(0.1458, range=0.0001..1))  # -> out, a; inputs run: Boolean, yawSensitivity: Double, pitchSensitivity: Double, deadzone: Double; disabled
# ---------- c_task_yaw_pitch_4: C# ----------
using System;
using System.Collections.Generic;
using System.Threading;
using System.Threading.Tasks;
using SharpDX.XInput;

using Rhino;
using Rhino.Geometry;

using Grasshopper;
using Grasshopper.Kernel;
using Grasshopper.Kernel.Data;
using Grasshopper.Kernel.Types;

#r "nuget: SharpDX, 4.2.0"
#r "nuget: SharpDX.XInput, 4.2.0"

public class Script_Instance : GH_ScriptInstance
{    
    private static CancellationTokenSource _cts;
    private static Status _status = Status.NotInitialized; 
    private List<int> _log;

    public enum Status
    {
        NotInitialized =0,
        Started =1,
        Stopped =2
    }

double _yawSensitivity,_pitchSensitivity,_deadzone;

    private void RunScript(
		bool run,
		double yawSensitivity,
		double pitchSensitivity,
		double deadzone,
		ref object a)
    {

        _yawSensitivity =yawSensitivity; 
        _pitchSensitivity =pitchSensitivity;
        _deadzone = deadzone;



        if(_status == Status.NotInitialized && run)
        {
            Initialize();
            Start();
        } else if (_status == Status.Stopped && run)
            Start();
        else if (_status == Status.Started && !run)
            Stop();

        a= _log;
    }

    void Initialize()
    {
        _log = new List<int>();
    }

    async Task  Loop( CancellationToken token)
    {
        Controller controller = new Controller(UserIndex.One);
        
        while (!token.IsCancellationRequested)
        {  

            if (controller.IsConnected)
                {
                    var state = controller.GetState();

                    Gamepad pad = state.Gamepad;

                    short rx = pad.RightThumbX;
                    short ry = pad.RightThumbY;

                    double normX = rx / 32767.0;
                    double normY = ry / 32767.0;

                    normX = Math.Clamp(normX,-1,1);
                    normY = Math.Clamp(normY,-1,1);

                    double magnitude = Math.Sqrt(normX * normX + normY * normY);

                    double deadzoneFixed = (magnitude - _deadzone) / (1 - _deadzone);
                    deadzoneFixed = Math.Clamp(deadzoneFixed, 0, 1);

                    // Normalize vector
                    double directionX = normX / magnitude;
                    double directionY = normY / magnitude;

                    // Final scaled input
                    double finalX = directionX * deadzoneFixed;
                    double finalY = directionY * deadzoneFixed;

                    double yawAngle = -finalX * _yawSensitivity;
                    double pitchAngle = finalY * _pitchSensitivity;

                  

                    if (magnitude < _deadzone)
                    {
                    
                    }else
                    {
                    //            // Update the camera on the UI thread.
                    Rhino.RhinoApp.InvokeOnUiThread((Action)(() =>
                    {
                     var view = RhinoDoc.ActiveDoc.Views.ActiveView;
                            if (view != null)
                            {
                                var vp = view.ActiveViewport;
                                
                                // Get the current camera direction as a normalized vector.
                                Vector3d camDir = vp.CameraDirection;
                                if (camDir.Length < Rhino.RhinoMath.ZeroTolerance)
                                    camDir = new Vector3d(0, 1, 0);
                                camDir.Unitize();
                                
                                // --- Yaw Rotation ---
                                // Rotate the camera direction around the world up (Z-axis).
                                Transform yawTransform = Transform.Rotation(yawAngle, Vector3d.ZAxis, Point3d.Origin);
                                camDir.Transform(yawTransform);
                                
                                // --- Pitch Rotation ---
                                // Compute the right vector from the updated direction.
                                Vector3d right = Vector3d.CrossProduct(camDir, Vector3d.ZAxis);
                                if (right.Length < Rhino.RhinoMath.ZeroTolerance)
                                    right = new Vector3d(1, 0, 0);
                                right.Unitize();
                                Transform pitchTransform = Transform.Rotation(pitchAngle, right, Point3d.Origin);
                                camDir.Transform(pitchTransform);
                                
                                // Set the updated camera direction.
                                vp.SetCameraDirection(camDir, true);
                                view.Redraw();
                            }
                    }));
                     }
         
            

                }

           
            
            await Task.Delay(10, token);

            ExpireSolution();
        }
    }

    void Stop()
    {
        _cts.Cancel();
        _status = Status.Stopped;
    }

    void Start()
    {
        _cts = new CancellationTokenSource();
        _ = Task.Run(() => Loop(_cts.Token), _cts.Token);
        _status = Status.Started;
    }

    void ExpireSolution()
    {
        // Credit: David Rutten, Eric Anastas
        // https://www.grasshopper3d.com/forum/topics/triggering-solution-refresh?overrideMobileRedirect=1&id=2985220%3ATopic%3A170034&page=1
        var expireAction = new Action<bool>(this.Component.ExpireSolution);

        Grasshopper.Instances.ActiveCanvas.Invoke(expireAction, new object[] { true });
        //The Action has to be invoked, because this method is called by the worker thread and not the mainthread
    }  
}
# ---------- end c_task_yaw_pitch_4 ----------
panel_15 = Panel(c_task_yaw_pitch_2.a)
panel_16 = Panel(c_task_yaw_pitch_3.a)
panel_17 = Panel(c_task_yaw_pitch_4.a)
